# Grasshopper definition 20221107_design_form_rotation_gh_BR.ghx (Grasshopper 1.0.7)
# plug-ins: treesloth01

rotate_v = Slider(0, range=0..100)
panel = Panel("12")

# ----
# Height and Angle Adjust
panel_2 = Panel("150 to 500")
bnd = Bounds(Numbers=rotate_v)
remap = RemapNumbers(Value=rotate_v, Source=bnd, Target=panel_2)  # -> Mapped, Clipped
pt = ConstructPoint(XCoordinate=0, YCoordinate=0, ZCoordinate=remap.Mapped)

series = Series(Start=0, Step="15", Count=Slider(12, range=0..100))

# ----
# Base Points
cir = Circle(Plane=PlaneXY(0, 0, 0), Radius=Slider(175, range=0..175))
divide = DivideCurve(Curve=cir, Count="60", Kinks=False)  # -> Points, Tangents, Parameters
item = ListItem(List=divide.Points, Index=rotate_v, Wrap=True)

# ----
# Weavy Form
number_slider = Slider(0.5, range=0..1)
pi = Pi(Factor="4")
range = Range(Domain=pi, Steps=Slider(59, range=0..100))
pi_2 = Pi(Factor=number_slider)
addition = Addition(A=range, B=pi_2)
sin = Sine(Value=addition)
remap_2 = RemapNumbers(Value=sin, Source=Domain(0, 1), Target=Domain(0, 1))  # -> Mapped, Clipped
multiplication = Multiplication(A=remap_2.Mapped, B=Slider(46, range=0..100))
Z = UnitZ(Factor=multiplication)

# ----
# Base Reparametrized
crv_cp = CurveClosestPoint(Point=item, Curve=cir)  # -> Point, Parameter, Distance
seam = Seam(Curve=cir, Seam=crv_cp.Parameter)  # -> flatten(Curve)

vec2pt = Vector2Pt(PointA=pt, PointB=item, Unitize=True)  # -> Vector, Length
multiplication_2 = Multiplication(A=series, B=vec2pt.Vector)
rev = Reverse(Vector=multiplication_2)
move = Move(Geometry=cir, Motion=rev)  # -> Geometry, Transform
first_last = FirstLast(List=move.Geometry)  # -> FirstValue, LastValue
crv_cp_2 = CurveClosestPoint(Point=item, Curve=first_last.LastValue)  # -> Point, Parameter, Distance
seam_2 = Seam(Curve=first_last.LastValue, Seam=crv_cp_2.Parameter)
divide_2 = DivideCurve(Curve=seam_2, Count="60", Kinks=False)  # -> Points, Tangents, Parameters
move_2 = Move(Geometry=divide_2.Points, Motion=expr("-x", Z))  # -> Geometry, Transform
intcrv = Interpolate(Vertices=move_2.Geometry, Degree=3, Periodic=True, KnotStyle=1)  # -> flatten(Curve), Length, Domain
loft = Loft(
    Curves=[intcrv.Curve, seam],
    Options={Adjust=False, Closed=False, LoftEnds=0, LoftSimp=0, LoftType=0, Rebuild=10, Refit=0.01})
