# Grasshopper definition 20221109_Wave Form Python_Animation_BR_0.1.ghx (Grasshopper 1.0.7)
# plug-ins: Heteroptera

number_slider = Slider(0.9, range=0..1)  # disabled
number_slider_2 = Slider(2, range=1..4)  # disabled
number_slider_3 = Slider(0.25, range=0..1)  # disabled

# ----
# Contour Lines
number_slider_4 = Slider(2, range=1..4)
multiplication = Multiplication(A=number_slider_4, B=Slider(0.25, range=0..1))
rad = Radians(Degrees=Slider(15, range=0..100))
python = GhPythonScript(
    r=Slider(175, range=0..1000),
    t=multiplication,
    div=Slider(60, range=0..100),
    h=Slider(160, range=0..200),
    tilt=Slider(2, range=1..6),
    gap_z=Slider(0, range=0..10),
    bricks_angle=rad)  # -> out, up_crv, base_pts, base_crv, vec_xy_pl, wall, grid_pts, brick_pts; inputs div: Int32, gap_z: Int32
# ---------- python: Python ----------
__author__ = "jiang"
__version__ = "2022.11.03"

import rhinoscriptsyntax as rs
import Rhino.Geometry as rg
import Rhino
import math
import copy

length = 30
width = 15
height = 10

#make and reparameterize circle to crv
base_crv = rg.Circle.ToNurbsCurve(rg.Circle(rg.Point3d(0,0,0),r))
base_crv.Domain = rg.Interval(0,1)

# make the a point on circle as end point
id_pt = rg.Curve.ChangeClosedCurveSeam(base_crv,t)

#t value on circle
para = rg.Curve.DivideByCount(base_crv, div, True)

#base points for curv
base_pts = []
for p in para:
    base_pts.append(base_crv.PointAt(p))
    
#rotation direction
vec_xy_pl = rg.Vector3d(base_pts[0]-rg.Point3d(0,0,0))

# z_value of upper points
z_value=[]
for i in range(len(base_pts)):
    z_value.append(math.sin(((4*math.pi/len(base_pts))*i)+math.pi*0.5)*r/5)

#upper points for crv
up_pts = copy.deepcopy(base_pts)

for i, pt in enumerate(up_pts):
    tranMatrix = rg.Transform.Translation(rg.Vector3d(0, 0,z_value[i]+h))
    pt.Transform(tranMatrix)

for p, pt in enumerate(up_pts):
    pt.Transform(rg.Transform.Translation(vec_xy_pl/tilt))

#add end_pt to close the curve
end_pt= copy.copy(up_pts[0])
up_pts.append(end_pt)
up_crv = rg.Curve.CreateInterpolatedCurve(up_pts, 3,rg.CurveKnotStyle(3))


#crvs to wall brep
loft_crvs = [base_crv, up_crv]
wall = rg.Brep.CreateFromLoft(loft_crvs, rg.Point3d.Unset, rg.Point3d.Unset, rg.LoftType.Tight, False)


# from base_pts to pt_grid 
#a)difine layers
grid_length = base_pts[0].DistanceTo(up_pts[0])
grid_layer_cnt = int(math.ceil(grid_length/height))
#b)define move direction
grid_direction = rg.Vector3d(rg.Point3d(0,0,z_value[0]+h)-rg.Point3d(0,0,0))+(vec_xy_pl/tilt)
#c) move angle to xy_plane
grid_angle = rg.Vector3d.VectorAngle(grid_direction, vec_xy_pl)
grid_direction.Unitize()
#d) move distance of each pt
grid_unit = height/math.sin(grid_angle)+gap_z

grid_pts=[]
for h in range(grid_layer_cnt):
#    plane_pts = []
    for pt in base_pts:
        pt = copy.copy(pt)
        t = rg.Transform(rg.Transform.Translation(h*(grid_direction*grid_unit)))
        pt.Transform(t)
#        plane_pts.append(pt)
        grid_pts.append(pt)

#seclect brick pts
brick_pts = grid_pts[::2]
# ---------- end python ----------
brep = Brep(python.wall)
pt = Point(python.grid_pts)
pt_2 = Point(python.brick_pts)
crv = Curve(python.base_crv)
crv_2 = Curve(python.up_crv)
item = ListItem(List=pt_2, Index="6", Wrap=True)
item_2 = ListItem(List=pt_2, Index="36", Wrap=True)
vec2pt = Vector2Pt(PointA=item, PointB=item_2, Unitize=False)  # -> Vector, Length
unit = UnitVector(Vector=vec2pt.Vector)
series = Series(Start=0, Step=Slider(11, range=0..100), Count=Slider(25, range=0..100))
multiplication_2 = Multiplication(A=unit, B=series)
move = Move(Geometry=crv, Motion=multiplication_2)  # -> Geometry, Transform
dispatch = Dispatch(List=move.Geometry, DispatchPattern=[True, False])  # -> graft(ListA), graft(ListB)

panel = Panel("175")  # disabled
number_slider_5 = Slider(15, range=0..100)  # disabled
number_slider_6 = Slider(0, range=0..10)  # disabled
number_slider_7 = Slider(60, range=0..100)  # disabled
number_slider_8 = Slider(120, range=0..120)  # disabled
number_slider_9 = Slider(6, range=1..6)  # disabled
number_slider_10 = Slider(175, range=0..1000)  # disabled
multiplication_3 = Multiplication(A=number_slider_2, B=number_slider_3)  # disabled
rad_2 = Radians(Degrees=number_slider_5)  # disabled
number_slider_11 = Slider(30, range=0..100)  # disabled
number_slider_12 = Slider(15, range=0..100)  # disabled
number_slider_13 = Slider(10, range=0..10)  # disabled
python_2 = GhPythonScript(
    r=number_slider_10,
    t=multiplication_3,
    div=number_slider_7,
    h=number_slider_8,
    tilt=number_slider_9,
    gap_z=number_slider_6,
    bricks_angle=rad_2)  # -> out, up_crv, base_pts, base_crv, vec_xy_pl, wall, grid_pts, brick_pts; inputs div: Int32, gap_z: Int32; disabled
# ---------- python_2: Python ----------
__author__ = "jiang"
__version__ = "2022.11.03"

import rhinoscriptsyntax as rs
import Rhino.Geometry as rg
import Rhino
import math
import copy

length = 30
width = 15
height = 10

#make and reparameterize circle to crv
base_crv = rg.Circle.ToNurbsCurve(rg.Circle(rg.Point3d(0,0,0),r))
base_crv.Domain = rg.Interval(0,1)

# make the a point on circle as end point
id_pt = rg.Curve.ChangeClosedCurveSeam(base_crv,t)

#t value on circle
para = rg.Curve.DivideByCount(base_crv, div, True)

#base points for curv
base_pts = []
for p in para:
    base_pts.append(base_crv.PointAt(p))
    
#rotation direction
vec_xy_pl = rg.Vector3d(base_pts[0]-rg.Point3d(0,0,0))

# z_value of upper points
z_value=[]
for i in range(len(base_pts)):
    z_value.append(math.sin(((4*math.pi/len(base_pts))*i)+math.pi*1)*r/5)
#    z_value.append(math.sin(((4*math.pi/len(base_pts))*i)+math.pi*0.5)*r/5)

#upper points for crv
up_pts = copy.deepcopy(base_pts)

for i, pt in enumerate(up_pts):
    tranMatrix = rg.Transform.Translation(rg.Vector3d(0, 0,z_value[i]+h))
    pt.Transform(tranMatrix)

for p, pt in enumerate(up_pts):
    pt.Transform(rg.Transform.Translation(vec_xy_pl/tilt))

#add end_pt to close the curve
end_pt= copy.copy(up_pts[0])
up_pts.append(end_pt)
up_crv = rg.Curve.CreateInterpolatedCurve(up_pts, 3,rg.CurveKnotStyle(3))


#crvs to wall brep
loft_crvs = [base_crv, up_crv]
wall = rg.Brep.CreateFromLoft(loft_crvs, rg.Point3d.Unset, rg.Point3d.Unset, rg.LoftType.Tight, False)


# from base_pts to pt_grid 
#a)difine layers
#Alternative_grid_length = base_pts[0].DistanceTo(up_pts[0])
grid_length = 
grid_layer_cnt = int(math.ceil(grid_length/height))
#b)define move direction
grid_direction = rg.Vector3d(rg.Point3d(0,0,z_value[0]+h)-rg.Point3d(0,0,0))+(vec_xy_pl/tilt)
#c) move angle to xy_plane
grid_angle = rg.Vector3d.VectorAngle(grid_direction, vec_xy_pl)
grid_direction.Unitize()
#d) move distance of each pt
grid_unit = height/math.sin(grid_angle)+gap_z

grid_pts=[]
for h in range(grid_layer_cnt):
    plane_pts = []
    for pt in base_pts:
        pt = copy.copy(pt)
        t = rg.Transform(rg.Transform.Translation(h*(grid_direction*grid_unit)))
        pt.Transform(t)
        plane_pts.append(pt)
    grid_pts.append(plane_pts)

#seclect brick pts
brick_pts = []
for i , plane in enumerate( grid_pts):
    if i%2== 0:
        brick_pt = grid_pts[::2]
    else:
        brick_pt = grid_pts[1::2]
    brick_pts.append(brick_pt)
    
print type(brick_pts)
# ---------- end python_2 ----------
number_slider_14 = Slider(15, range=0..100)  # disabled
brep_2 = Brep(python_2.wall)  # disabled
python_3 = GhPythonScript(x=python_2.brick_pts)  # -> out, a; disabled
# ---------- python_3: Python ----------
__author__ = "jiang"
__version__ = "2022.11.08"

import rhinoscriptsyntax as rs

a= x
# ---------- end python_3 ----------
box = DomainBox(Base=PlaneXY(0, 0, 0), X=number_slider_12, Y=number_slider_11, Z=number_slider_13)  # disabled
Y = UnitY(Factor=1)
python_4 = GhPythonScript(x=python_3.a)  # -> out, a; disabled; same code as python_3
yz = YZPlane(Origin=Point(0, 0, 0))  # disabled
rad_3 = Radians(Degrees=number_slider_14)  # disabled
rot3d = Rotate3D(Geometry=brep, Angle=degrees(Slider(10, range=0..10)), Center=Point(0, 0, 0), Axis=Y)  # -> Geometry, Transform
pt_3 = Point(python_4.a)  # disabled
rotate = Rotate(Geometry=box, Angle=rad_3, Plane=yz)  # -> Geometry, Transform; disabled
rotate_2 = Rotate(Geometry=rotate.Geometry, Angle=1.570796327, Plane=PlaneXY(0, 0, 0))  # -> Geometry, Transform; disabled
division = Division(A="10", B="2")
Z = UnitZ(Factor=division)
B = Base(PlaneXY(0, 0, 0))
move_2 = Move(Geometry=B, Motion=Z)  # -> Geometry, Transform

# ----
# Animation Frames
number_slider_15 = Slider(512, range=0..512)

# ----
# Animation
number_slider_16 = Slider(100, range=0..1000)
dom = ConstructDomain(DomainStart="1", DomainEnd="512")
range = Range(Domain=Domain(0, 1), Steps=dom)
pt_4 = ConstructPoint(XCoordinate=0, YCoordinate=0, ZCoordinate=0)
Z_2 = UnitZ(Factor=number_slider_16)
item_3 = ListItem(List=range, Index=number_slider_15, Wrap=True)
move_3 = Move(Geometry=pt_4, Motion=Z_2)  # -> Geometry, Transform
cir = Circle(Plane=pt_4, Radius=Slider(1599, range=0..2000))
Z_3 = UnitZ(Factor=Slider(720, range=0..1000))
rotate_3 = Rotate(Geometry=cir, Angle=degrees("90"), Plane=PlaneXY(0, 0, 0))  # -> Geometry, Transform
move_4 = Move(Geometry=rotate_3.Geometry, Motion=Z_3)  # -> Geometry, Transform
eval = EvaluateCurve(Curve=reparameterize(move_4.Geometry), Parameter=item_3)  # -> Point, Tangent, Angle
camera = CameraCrane(
    Location=eval.Point,
    Target=move_3.Geometry,
    Lense=Slider(100, range=0..100),
    Perspective=Slider(1, range=0..1),
    Refresh=Toggle(True))  # -> Camera, Target, Lens, Up, HorizontalViewAngle, VerticalViewAngle, ScreenRatio, Frame

panel_2 = Panel(item_3)

# ----
# Divide circles with different distence.
number_slider_17 = Slider(36, range=0..100)
range_2 = Range(Domain=Domain(0, 1), Steps=number_slider_17)
graph = GraphMapper(
    range_2,
    x0=0,
    x1=1,
    y0=0,
    y1=1,
    container_name="Sine",
    Equation_px=[0.007785962895, 0.2544272542],
    Equation_py=[0.4870889783, 1])
shift = ShiftList(List=graph, Shift="-1", Wrap=invert(True))
ma = MassAddition(Input=shift)  # -> Result, PartialResults
bnd = Bounds(Numbers=ma.PartialResults)
remap = RemapNumbers(Value=ma.PartialResults, Source=bnd, Target=Domain(0, 1))  # -> Mapped, Clipped
eval_2 = EvaluateLength(Curve=dispatch.ListA, Length=remap.Mapped, Normalized=True)  # -> simplify(Point), Tangent, Parameter
shatter = Shatter(Curve=dispatch.ListA, Parameters=eval_2.Parameter)
cull_i = CullIndex(List=eval_2.Point, Indices="35", Wrap=True)
curvepoint = PointOnCurve(shatter, parameter=0.5)
pl = PlaneNormal(Origin=cull_i, ZAxis=Vector(0, 0, 1))
move_5 = Move(Geometry=curvepoint, Motion=Vector(0, 0, 10))  # -> simplify(Geometry), Transform

# ---- group: First Layer
orient = Orient(Geometry=move_2.Geometry, Source=B, Target=pl)  # -> Geometry, Transform

# ---- group: Second Layer
orient_2 = Orient(Geometry=move_2.Geometry, Source=B, Target=move_5.Geometry)  # -> Geometry, Transform

# ----
merge = Merge(Data1=orient.Geometry, Data2=orient_2.Geometry)  # -> flatten(Result)

# ----
# Make a Brick
panel_3 = Panel("10")
box_2 = CenterBox(Base=merge, X=expr("x/2", "32.8"), Y=expr("x/2", "15.5"), Z=expr("x/2", panel_3))

colom = CollisionOneMany(Collider=box_2, Obstacles=brep)  # -> Collision, Index
cull = CullPattern(List=merge, CullPattern=colom.Collision)

# ----
# Make the bottom of the brick lamp flat
number_slider_18 = Slider(10, range=0..10)
Y_2 = UnitY(Factor=1)
rot3d_2 = Rotate3D(Geometry=cull, Angle=degrees(number_slider_18), Center=Point(0, 0, 0), Axis=Y_2)  # -> Geometry, Transform
flatten = FlattenTree(Tree=rot3d_2.Geometry, Path="{0}")
series_2 = Series(Start=0, Step=1, Count="512")

deplane = DeconstructPlane(Plane=rot3d_2.Geometry)  # -> Origin, XAxis, YAxis, ZAxis

pdecon = Deconstruct(Point=deplane.Origin)  # -> XComponent, YComponent, ZComponent
flatten_2 = FlattenTree(Tree=pdecon.ZComponent, Path="{0}")
sort = SortList(Keys=flatten_2, ValuesA=flatten)  # -> Keys, ValuesA
larger = LargerThan(FirstNumber=sort.Keys, SecondNumber=Slider(27, range=0..100))  # -> LargerThan, OrEqualTo
dispatch_2 = Dispatch(List=sort.ValuesA, DispatchPattern=larger.LargerThan)  # -> ListA, ListB

# ----
# Bake these Planes
geo = Geometry(dispatch_2.ListA)

lng = ListLength(List=geo)
dom_2 = ConstructDomain(DomainStart=0, DomainEnd=lng)
panel_4 = Panel(lng)
subset = SubList(List=geo, Domain=dom_2, Wrap=True)  # -> List, Index

# ----
# Make a Brick
panel_5 = Panel("10")
box_3 = CenterBox(Base=subset.List, X=expr("x/2", "32.8"), Y=expr("x/2", "15.5"), Z=expr("x/2", panel_5))

item_4 = ListItem(List=box_3, Index=series_2, Wrap=True)
preview = CustomPreview(Geometry=item_4, Material=ColourSwatch(SwatchColor=RGB(255, 255, 255)))
