# Grasshopper definition Wave Form Python.ghx (Grasshopper 1.0.7)

number_slider = Slider(0.9, range=0..1)
number_slider_2 = Slider(0.2, range=0..1)
panel = Panel("175")
multiplication = Multiplication(A=Slider(2, range=1..4), B=Slider(0.25, range=0..1))
multiplication_2 = Multiplication(A=Slider(2, range=1..4), B=Slider(0.25, range=0..1))
rad = Radians(Degrees=Slider(15, range=0..100))
rad_2 = Radians(Degrees=Slider(15, range=0..100))
python = GhPythonScript(
    r=Slider(175, range=0..1000),
    t=multiplication,
    div=Slider(60, range=0..100),
    h=Slider(120, range=0..120),
    tilt=Slider(6, range=1..6),
    gap_z=Slider(0, range=0..10),
    bricks_angle=rad)  # -> out, up_crv, base_pts, base_crv, vec_xy_pl, wall, grid_pts, brick_pts; inputs div: Int32, gap_z: Int32
# ---------- python: Python ----------
__author__ = "jiang"
__version__ = "2022.11.03"

import rhinoscriptsyntax as rs
import Rhino.Geometry as rg
import Rhino
import math
import copy

length = 30
width = 15
height = 10

#make and reparameterize circle to crv
base_crv = rg.Circle.ToNurbsCurve(rg.Circle(rg.Point3d(0,0,0),r))
base_crv.Domain = rg.Interval(0,1)

# make the a point on circle as end point
id_pt = rg.Curve.ChangeClosedCurveSeam(base_crv,t)

#t value on circle
para = rg.Curve.DivideByCount(base_crv, div, True)

#base points for curv
base_pts = []
for p in para:
    base_pts.append(base_crv.PointAt(p))
    
#rotation direction
vec_xy_pl = rg.Vector3d(base_pts[0]-rg.Point3d(0,0,0))

# z_value of upper points
z_value=[]
for i in range(len(base_pts)):
    z_value.append(math.sin(((4*math.pi/len(base_pts))*i)+math.pi*1)*r/5)
#    z_value.append(math.sin(((4*math.pi/len(base_pts))*i)+math.pi*0.5)*r/5)

#upper points for crv
up_pts = copy.deepcopy(base_pts)

for i, pt in enumerate(up_pts):
    tranMatrix = rg.Transform.Translation(rg.Vector3d(0, 0,z_value[i]+h))
    pt.Transform(tranMatrix)

for p, pt in enumerate(up_pts):
    pt.Transform(rg.Transform.Translation(vec_xy_pl/tilt))

#add end_pt to close the curve
end_pt= copy.copy(up_pts[0])
up_pts.append(end_pt)
up_crv = rg.Curve.CreateInterpolatedCurve(up_pts, 3,rg.CurveKnotStyle(3))


#crvs to wall brep
loft_crvs = [base_crv, up_crv]
wall = rg.Brep.CreateFromLoft(loft_crvs, rg.Point3d.Unset, rg.Point3d.Unset, rg.LoftType.Tight, False)


# from base_pts to pt_grid 
#a)difine layers
#Alternative_grid_length = base_pts[0].DistanceTo(up_pts[0])
grid_length = 
grid_layer_cnt = int(math.ceil(grid_length/height))
#b)define move direction
grid_direction = rg.Vector3d(rg.Point3d(0,0,z_value[0]+h)-rg.Point3d(0,0,0))+(vec_xy_pl/tilt)
#c) move angle to xy_plane
grid_angle = rg.Vector3d.VectorAngle(grid_direction, vec_xy_pl)
grid_direction.Unitize()
#d) move distance of each pt
grid_unit = height/math.sin(grid_angle)+gap_z

grid_pts=[]
for h in range(grid_layer_cnt):
    plane_pts = []
    for pt in base_pts:
        pt = copy.copy(pt)
        t = rg.Transform(rg.Transform.Translation(h*(grid_direction*grid_unit)))
        pt.Transform(t)
        plane_pts.append(pt)
    grid_pts.append(plane_pts)

#seclect brick pts
brick_pts = []
for i , plane in enumerate( grid_pts):
    if i%2== 0:
        brick_pt = grid_pts[::2]
    else:
        brick_pt = grid_pts[1::2]
    brick_pts.append(brick_pt)
    
print type(brick_pts)
# ---------- end python ----------
python_2 = GhPythonScript(
    r=Slider(175, range=0..1000),
    t=multiplication_2,
    div=Slider(60, range=0..100),
    h=Slider(120, range=0..120),
    tilt=Slider(6, range=1..6),
    gap_z=Slider(0, range=0..10),
    bricks_angle=rad_2)  # -> out, up_crv, base_pts, base_crv, vec_xy_pl, wall, grid_pts, brick_pts; inputs div: Int32, gap_z: Int32
# ---------- python_2: Python ----------
__author__ = "jiang"
__version__ = "2022.11.03"

import rhinoscriptsyntax as rs
import Rhino.Geometry as rg
import Rhino
import math
import copy

length = 30
width = 15
height = 10

#make and reparameterize circle to crv
base_crv = rg.Circle.ToNurbsCurve(rg.Circle(rg.Point3d(0,0,0),r))
base_crv.Domain = rg.Interval(0,1)

# make the a point on circle as end point
id_pt = rg.Curve.ChangeClosedCurveSeam(base_crv,t)

#t value on circle
para = rg.Curve.DivideByCount(base_crv, div, True)

#base points for curv
base_pts = []
for p in para:
    base_pts.append(base_crv.PointAt(p))
    
#rotation direction
vec_xy_pl = rg.Vector3d(base_pts[0]-rg.Point3d(0,0,0))

# z_value of upper points
z_value=[]
for i in range(len(base_pts)):
    z_value.append(math.sin(((4*math.pi/len(base_pts))*i)+math.pi*0.5)*r/5)

#upper points for crv
up_pts = copy.deepcopy(base_pts)

for i, pt in enumerate(up_pts):
    tranMatrix = rg.Transform.Translation(rg.Vector3d(0, 0,z_value[i]+h))
    pt.Transform(tranMatrix)

for p, pt in enumerate(up_pts):
    pt.Transform(rg.Transform.Translation(vec_xy_pl/tilt))

#add end_pt to close the curve
end_pt= copy.copy(up_pts[0])
up_pts.append(end_pt)
up_crv = rg.Curve.CreateInterpolatedCurve(up_pts, 3,rg.CurveKnotStyle(3))


#crvs to wall brep
loft_crvs = [base_crv, up_crv]
wall = rg.Brep.CreateFromLoft(loft_crvs, rg.Point3d.Unset, rg.Point3d.Unset, rg.LoftType.Tight, False)


# from base_pts to pt_grid 
#a)difine layers
grid_length = base_pts[0].DistanceTo(up_pts[0])
grid_layer_cnt = int(math.ceil(grid_length/height))
#b)define move direction
grid_direction = rg.Vector3d(rg.Point3d(0,0,z_value[0]+h)-rg.Point3d(0,0,0))+(vec_xy_pl/tilt)
#c) move angle to xy_plane
grid_angle = rg.Vector3d.VectorAngle(grid_direction, vec_xy_pl)
grid_direction.Unitize()
#d) move distance of each pt
grid_unit = height/math.sin(grid_angle)+gap_z

grid_pts=[]
for h in range(grid_layer_cnt):
#    plane_pts = []
    for pt in base_pts:
        pt = copy.copy(pt)
        t = rg.Transform(rg.Transform.Translation(h*(grid_direction*grid_unit)))
        pt.Transform(t)
#        plane_pts.append(pt)
        grid_pts.append(pt)

#seclect brick pts
brick_pts = grid_pts[::2]
# ---------- end python_2 ----------
python_3 = GhPythonScript(x=python.brick_pts)  # -> out, a
# ---------- python_3: Python ----------
__author__ = "jiang"
__version__ = "2022.11.08"

import rhinoscriptsyntax as rs

a= x
# ---------- end python_3 ----------
box = DomainBox(Base=PlaneXY(0, 0, 0), X=Slider(15, range=0..100), Y=Slider(30, range=0..100), Z=Slider(10, range=0..10))
brep = Brep(python.wall)
brep_2 = Brep(python_2.wall)
pt = Point(python_2.brick_pts)
pt_2 = Point(python_2.grid_pts)
rad_3 = Radians(Degrees=Slider(15, range=0..100))
python_4 = GhPythonScript(x=python_3.a)  # -> out, a; same code as python_3
yz = YZPlane(Origin=Point(0, 0, 0))
pt_3 = Point(python_4.a)
rotate = Rotate(Geometry=box, Angle=rad_3, Plane=yz)  # -> Geometry, Transform
panel_2 = Panel(python_4.a)
rotate_2 = Rotate(Geometry=rotate.Geometry, Angle=1.570796327, Plane=PlaneXY(0, 0, 0))  # -> Geometry, Transform
panel_3 = Panel(python.brick_pts)
