# Grasshopper definition Wave Form Python.ghx (Grasshopper 1.0.7)

number_slider = Slider(0.2, range=0..1)
series = Series(Start=0, Step=1, Count=10)
vector = Vector(Vector(0.4093917282, 0, -0.9123587085))
_222 = Vector(Vector(87.5, 0, -195))
multiplication = Multiplication(A=Slider(2, range=1..4), B=Slider(0.25, range=0..1))
rad = Radians(Degrees=Slider(15, range=0..100))
_2 = Vector(Vector(87.5, 0, -195))
python = GhPythonScript(
    r=Slider(175, range=0..1000),
    t=multiplication,
    div=Slider(60, range=0..100),
    h=Slider(160, range=0..200),
    tilt=Slider(2, range=1..6),
    gap_z=Slider(0, range=0..10),
    bricks_angle=rad,
    wave=series,
    vec=vector)  # -> out, up_crv, base_pts, base_crv, vec_xy_pl, wall, grid_pts, brick_pts, a; inputs div: Int32, gap_z: Int32
# ---------- python: Python ----------
__author__ = "jiang"
__version__ = "2022.11.03"

import rhinoscriptsyntax as rs
import Rhino.Geometry as rg
import Rhino
import math
import copy

length = 30
width = 15
height = 10

#make and reparameterize circle to crv
base_crv = rg.Circle.ToNurbsCurve(rg.Circle(rg.Point3d(0,0,0),r))
base_crv.Domain = rg.Interval(0,1)

# make the a point on circle as end point
id_pt = rg.Curve.ChangeClosedCurveSeam(base_crv,t)

#t value on circle
para = rg.Curve.DivideByCount(base_crv, div, True)

#base points for curv
base_pts = []
for p in para:
    base_pts.append(base_crv.PointAt(p))
    
#rotation direction
#vec_xy_pl = rg.Vector3d(base_pts[0]-rg.Point3d(0,0,0))
vec_xy_pl = -vec
# z_value of upper points
z_value=[]
for i in range(len(base_pts)):
    z_value.append(math.sin(((4*math.pi/len(base_pts))*i)+math.pi*(wave+0.5))*r/5)

#upper points for crv
up_pts = copy.deepcopy(base_pts)

for i, pt in enumerate(up_pts):
    tranMatrix = rg.Transform.Translation(-vec *(z_value[i]+h))
    pt.Transform(tranMatrix)

for p, pt in enumerate(up_pts):
    pt.Transform(rg.Transform.Translation(vec_xy_pl/tilt))

#add end_pt to close the curve
end_pt= copy.copy(up_pts[0])
up_pts.append(end_pt)
up_crv = rg.Curve.CreateInterpolatedCurve(up_pts, 3,rg.CurveKnotStyle(3))


#crvs to wall brep
loft_crvs = [base_crv, up_crv]
wall = rg.Brep.CreateFromLoft(loft_crvs, rg.Point3d.Unset, rg.Point3d.Unset, rg.LoftType.Tight, False)


# from base_pts to pt_grid 
#a)difine layers
grid_length = base_pts[0].DistanceTo(up_pts[0])
grid_layer_cnt = int(math.ceil(grid_length/height))
#b)define move direction
#grid_direction = rg.Vector3d(rg.Point3d(0,0,z_value[0]+h)-rg.Point3d(0,0,0))+(vec_xy_pl/tilt)
grid_direction = -vec
#c) move angle to xy_plane
grid_angle = rg.Vector3d.VectorAngle(grid_direction, vec_xy_pl)
grid_direction.Unitize()
#d) move distance of each pt
grid_unit = height/math.sin(grid_angle)+gap_z

grid_pts=[]
for h in range(grid_layer_cnt):
#    plane_pts = []
    for pt in base_pts:
        pt = copy.copy(pt)
        t = rg.Transform(rg.Transform.Translation(h*(grid_direction*grid_unit)))
        pt.Transform(t)
#        plane_pts.append(pt)
        grid_pts.append(pt)
#
##seclect brick pts
brick_pts = grid_pts[::2]

a = rg.Vector3d(base_pts[0]-up_pts[0])
# ---------- end python ----------
crv = Curve(python.base_crv)
brep = Brep(python.wall)
pt = Point(python.grid_pts)
pt_2 = Point(python.brick_pts)
panel = Panel(python.a)
item = ListItem(List=pt_2, Index="6", Wrap=True)
item_2 = ListItem(List=pt_2, Index="36", Wrap=True)
vec2pt = Vector2Pt(PointA=item, PointB=item_2, Unitize=False)  # -> Vector, Length
unit = UnitVector(Vector=vec2pt.Vector)
series_2 = Series(Start=0, Step=Slider(11, range=0..100), Count=Slider(25, range=0..100))
multiplication_2 = Multiplication(A=unit, B=series_2)
move = Move(Geometry=crv, Motion=multiplication_2)  # -> Geometry, Transform
dispatch = Dispatch(List=move.Geometry, DispatchPattern=[True, False])  # -> graft(ListA), graft(ListB)
construct_plane = ConstructPlane(Origin=Point(0, 0, 0), XAxis=Vector(1, 0, 0), YAxis=Vector(0, 1, 0))
Y = UnitY(Factor=1)
flatten = FlattenTree(Path="{0}")
number_slider_2 = Slider(54, range=0..100)

# ----
# Make a Brick
B = Base(PlaneXY(0, 0, 0))
division = Division(A="10", B="2")
box = CenterBox(Base=B, X=expr("x/2", "32.8"), Y=expr("x/2", "15.5"), Z=expr("x/2", "10"))
Z = UnitZ(Factor=division)
move_2 = Move(Geometry=box, Motion=Z)  # -> Geometry, Transform

panel_2 = Panel("10")
geometry = Geometry({Plane=PlaneXY(0, 0, 5), X=Domain(-16.4, 16.4), Y=Domain(-7.75, 7.75), Z=Domain(-5, 5)})

number_slider_3 = Slider(30, range=0..100)
range = Range(Domain=Domain(0, 1), Steps=Slider(36, range=0..100))
graph = GraphMapper(
    range,
    x0=0,
    x1=1,
    y0=0,
    y1=1,
    container_name="Sine",
    Equation_px=[0.007785962895, 0.2544272542],
    Equation_py=[0.4870889783, 1])
shift = ShiftList(List=graph, Shift="-1", Wrap=invert(True))
ma = MassAddition(Input=shift)  # -> Result, PartialResults
bnd = Bounds(Numbers=ma.PartialResults)
remap = RemapNumbers(Value=ma.PartialResults, Source=bnd, Target=Domain(0, 1))  # -> Mapped, Clipped

list_length = ListLength(List=remap.Mapped)
construct_domain = ConstructDomain(DomainStart=0, DomainEnd=expr("x-2", list_length))
sub_list = SubList(List=remap.Mapped, Domain=construct_domain, Wrap=True)  # -> List, Index

eval = EvaluateLength(Curve=dispatch.ListA, Length=sub_list.List, Normalized=True)  # -> Point, Tangent, Parameter
pl = PlaneNormal(Origin=eval.Point, ZAxis=Vector(0, 0, 1))
shatter = Shatter(Curve=dispatch.ListA, Parameters=eval.Parameter)
curvepoint = PointOnCurve(shatter, parameter=0.5)
move_3 = Move(Geometry=curvepoint, Motion=Vector(0, 0, 10))  # -> simplify(Geometry), Transform

# ---- group: First Layer
orient = Orient(Geometry=move_2.Geometry, Source=B, Target=pl)  # -> Geometry, Transform

# ---- group: Second Layer
orient_2 = Orient(Geometry=move_2.Geometry, Source=B, Target=move_3.Geometry)  # -> Geometry, Transform

# ----
merge = Merge(Data1=orient.Geometry, Data2=orient_2.Geometry)  # -> flatten(Result)
colom = CollisionOneMany(Collider=merge, Obstacles=brep)  # -> Collision, Index
cull = CullPattern(List=merge, CullPattern=colom.Collision)
rot3d = Rotate3D(Geometry=cull, Angle=degrees(Slider(10, range=0..10)), Center=Point(0, 0, 0), Axis=Y)  # -> Geometry, Transform
volume = Volume(Geometry=rot3d.Geometry)  # -> Volume, Centroid
path_mapper = PathMapper(rot3d.Geometry, source="{a;b;c}", target="{c}")
pdecon = Deconstruct(Point=volume.Centroid)  # -> XComponent, YComponent, ZComponent
flatten_2 = FlattenTree(Tree=pdecon.ZComponent, Path="{0}")
path_mapper_2 = PathMapper(pdecon.ZComponent, source="{a;b;c}", target="{c}")
sort = SortList(Keys=path_mapper_2, ValuesA=path_mapper)  # -> Keys, ValuesA
larger = LargerThan(FirstNumber=sort.Keys, SecondNumber=Slider(27, range=0..100))  # -> LargerThan, OrEqualTo
dispatch_2 = Dispatch(List=sort.ValuesA, DispatchPattern=larger.LargerThan)  # -> ListA, ListB
geo = Geometry(dispatch_2.ListA)
deconstruct_brep = DeconstructBrep(Brep=dispatch_2.ListA)  # -> Faces, Edges, Vertices
list_item = ListItem(List=deconstruct_brep.Faces, Index=Slider(5, range=0..10), Wrap=True)
area = Area(Geometry=list_item)  # -> Area, Centroid
plane = Plane(list_item)
deconstruct_plane = DeconstructPlane(Plane=plane)  # -> Origin, XAxis, YAxis, ZAxis
construct_plane_2 = ConstructPlane(Origin=area.Centroid, XAxis=deconstruct_plane.XAxis, YAxis=deconstruct_plane.YAxis)
path_mapper_3 = PathMapper(construct_plane_2, source="{a;b}", target="{a}")
geometry_2 = Geometry(path_mapper_3)
panel_3 = Panel(path_mapper_3)
explode_tree = ExplodeTree(Data=geometry_2)  # -> Branch0, Branch1
ghpython_script = GhPythonScript(x=geometry_2)  # -> out, a; inputs x: tree of Plane; disabled
# ---------- ghpython_script: Python ----------
from ghpythonlib import treehelpers as t
from compas_rhino.conversions import plane_to_compas as tr
from Zorse import core_zFile as s

a = []

dic = {}
 
for i in range(x.BranchCount):
    branchList = x.Branch(i)
    branchPath = x.Path(i)
    
#    for j in range(branchList.Count):
    items =[]
    for j in branchList:
        zz = tr(j).to_jsonstring()
        items.append(zz)
    dic[str(branchPath)[1]] = items
#        s += type(branchList[j]).__name__ + ": "
#        s += str(tr(branchList[j]))

s.writeJson(r'C:\Zac\GitHub\endless-wall-teamwork\infinite','data.json',dic,True)
a= dic
# ---------- end ghpython_script ----------
geometry_3 = Geometry(explode_tree.Branch0)
panel_4 = Panel(ghpython_script.a)
