# Grasshopper definition infinite_clock.ghx (Grasshopper 1.0.7)

# ----
# Python Scripts
ghpython_script = GhPythonScript(file_name="infinite_clock.py")  # -> path
# ---------- ghpython_script: Python ----------
a = ghdoc.Path
b = ghdoc.Name

path = (a[::-1].replace('xhg.'+b[::-1].replace('*','',1),'',1))[::-1]

path = path.split('\\')

hierarchy_number = len(file_name.split('\\'))
out_path =''
for n in range(len(path)-hierarchy_number):
    out_path += path[n] +'\\'
out_path += file_name
path = out_path
#+file_name
# ---------- end ghpython_script ----------
read_file = ReadFile(File=ghpython_script, PerLineParse=False)

geometry = Geometry([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])
geometry_2 = Geometry([Plane(origin=(165.0456406, -0.004768539133, 31.9695985), x=(0, -1, 0), y=(0.984807753, 0, -0.1736481777)), Plane(origin=(163.8320291, 20.73157138, 32.18359094), x=(0, -1, 0), y=(0.984807753, 0, -0.1736481777)), Plane(origin=(163.8249753, -20.79151923, 32.18483472), x=(0, -1, 0), y=(0.984807753, 0, -0.1736481777)), Plane(origin=(-125.0268765, 118.5598921, 32.19987776), x=(0, -1, 0), y=(0.984807753, 0, -0.1736481777)), Plane(origin=(159.9141235, 42.38615933, 32.87442341), x=(0, -1, 0), y=(0.984807753, 0, -0.1736481777)), Plane(origin=(152.482557, 65.59095262, 34.18480908), x=(0, -1, 0), y=(0.984807753, 0, -0.1736481777))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])
count = Slider(0, range=0..100)
ghpython_script_2 = GhPythonScript(Code=read_file, Count=count)  # -> Out, A
