# Grasshopper definition rectangle-shape-practice.gh (Grasshopper 1.0.7)
# plug-ins: Palette, MetaHopper

offset = Slider(10, range=0..10)
brickheight = Panel("10")
bricklength = Panel("32")
brickwidth = Panel("15")
rectangle = Rectangle(Plane=PlaneXY(0, 0, 0), XSize=bricklength, YSize=brickwidth, Radius=0)  # -> Rectangle, Length
move = Move(Motion=Vector(0, 0, 10))  # -> Geometry, Transform
unit_z = UnitZ(Factor=offset)
unit_z_2 = UnitZ(Factor=brickheight)
boundary_surfaces = BoundarySurfaces(Edges=rectangle.Rectangle)
series = Series(Start=0, Step=Slider(19, range=0..100), Count=10)
extrude = Extrude(Base=boundary_surfaces, Direction=unit_z_2)
unit_y = UnitY(Factor=series)
unit_x = UnitX(Factor=series)
addition = Addition(A=unit_y, B=unit_x)
unit_z_3 = UnitZ(Factor=brickheight)
move_2 = Move(Geometry=extrude, Motion=addition)  # -> Geometry, Transform
move_3 = Move(Geometry=move_2.Geometry, Motion=unit_z_3)  # -> Geometry, Transform
subtraction = Subtraction(B=50)
area = Area(Geometry=move_3.Geometry)  # -> Area, Centroid
unit_y_2 = UnitY(Factor=Slider(11, range=0..100))
unit_x_2 = UnitX(Factor=Slider(9, range=0..100))
rotate = Rotate(Geometry=move_3.Geometry, Angle=1.570796327, Plane=area.Centroid)  # -> Geometry, Transform
colour_swatch = ColourSwatch(SwatchColor=RGB(255, 255, 255))
addition_2 = Addition(A=unit_x_2, B=unit_y_2)
palette = Palette(
    ModeCustomStandard=Toggle(True),
    Component_Normal_Deselected_Fill_Color=RGB(200, 200, 200),
    Component_Normal_Deselected_Edge_Color=RGB(50, 50, 50),
    Component_Normal_Deselected_Text_Color=RGB(0, 0, 0),
    Component_Normal_Selected_Fill_Color=RGB(130, 215, 50),
    Component_Normal_Selected_Edge_Color=RGB(0, 50, 0),
    Component_Normal_Selected_Text_Color=RGB(0, 25, 0),
    Component_Hidden_Deselected_Fill_Color=RGB(140, 140, 155),
    Component_Hidden_Deselected_Edge_Color=RGB(35, 35, 35),
    Component_Hidden_Deselected_Text_Color=RGB(0, 0, 0),
    Component_Hidden_Selected_Fill_Color=RGB(80, 180, 10),
    Component_Hidden_Selected_Edge_Color=RGB(0, 35, 0),
    Component_Hidden_Selected_Text_Color=RGB(0, 25, 0),
    Component_Disabled_Deselected_Fill_Color=RGB(120, 120, 120),
    Component_Disabled_Deselected_Edge_Color=RGB(90, 90, 90),
    Component_Disabled_Deselected_Text_Color=RGB(70, 70, 70),
    Component_Disabled_Selected_Fill_Color=RGB(110, 150, 115),
    Component_Disabled_Selected_Edge_Color=RGB(40, 70, 40),
    Component_Disabled_Selected_Text_Color=RGB(75, 100, 65),
    Component_Warning_Deselected_Fill_Color=RGB(255, 140, 20),
    Component_Warning_Deselected_Edge_Color=RGB(80, 10, 0),
    Component_Warning_Deselected_Text_Color=RGB(0, 0, 0),
    Component_Warning_Selected_Fill_Color=RGB(185, 205, 0),
    Component_Warning_Selected_Edge_Color=RGB(0, 50, 0),
    Component_Warning_Selected_Text_Color=RGB(0, 0, 0),
    Component_Error_Deselected_Fill_Color=RGB(200, 0, 0),
    Component_Error_Deselected_Edge_Color=RGB(60, 0, 0),
    Component_Error_Deselected_Text_Color=RGB(0, 0, 0),
    Component_Error_Selected_Fill_Color=RGB(125, 155, 0),
    Component_Error_Selected_Edge_Color=RGB(0, 50, 0),
    Component_Error_Selected_Text_Color=RGB(255, 255, 255),
    Component_Label_Deselected_Fill_Color=RGB(50, 50, 50),
    Component_Label_Deselected_Edge_Color=RGB(0, 0, 0),
    Component_Label_Deselected_Text_Color=RGB(255, 255, 255),
    Component_Label_Selected_Fill_Color=RGB(25, 60, 25),
    Component_Label_Selected_Edge_Color=RGB(0, 35, 0),
    Component_Label_Selected_Text_Color=RGB(190, 250, 180),
    Galapagos_Deselected_Fill_Color=RGB(255, 0, 125),
    Galapagos_Deselected_Edge_Color=RGB(100, 0, 50),
    Galapagos_Selected_Fill_Color=RGB(160, 210, 30),
    Galapagos_Selected_Edge_Color=RGB(0, 50, 0),
    Wire_Normal_Color=colour_swatch,
    Wire_Empty_Color=RGBA(255, 60, 0, 180),
    Wire_Selected_Start_Color=RGB(125, 210, 40),
    Wire_Selected_End_Color=colour_swatch,
    Panel_Default_Color=ColourSwatch(SwatchColor=RGBA(255, 255, 255, 200)),
    Group_Default_Color=ColourSwatch(SwatchColor=RGBA(255, 255, 255, 80)),
    Canvas_Background_Color=RGB(212, 208, 200),
    Canvas_Gridline_Color=RGBA(0, 0, 0, 30),
    Canvas_Gridline_Width=150,
    Canvas_Gridline_Height=50,
    Canvas_Edge_Color=RGB(0, 0, 0),
    Canvas_Shadow_Color=RGBA(0, 0, 0, 80),
    Canvas_Shadow_Size=30,
    MonochromaticOnOff=Toggle(True),
    Monochromatic_Color=ColourSwatch(SwatchColor=RGB(0, 0, 0)))
move_4 = Move(Geometry=rotate.Geometry, Motion=addition_2)  # -> Geometry, Transform
capture_gh_canvas = CaptureGHCanvas(
    Capture=Button(),
    ScaleFactor=1,
    SaveLocation="C:\Users\Zac\Desktop\GH_Capture.png",
    BackgroundColor=ColourSwatch(SwatchColor=RGB(0, 0, 0)))
list_length = ListLength(List=move_4.Transform)
area_2 = Area(Geometry=move_2.Geometry)  # -> Area, Centroid
construct_domain = ConstructDomain(DomainStart=0, DomainEnd=expr("x-2", list_length))
unit_z_4 = UnitZ(Factor=expr("x/2", brickheight))
plane = Plane(area_2.Centroid)
move_5 = Move(Geometry=plane, Motion=unit_z)  # -> Geometry, Transform
move_6 = Move(Geometry=plane, Motion=unit_z_4)  # -> Geometry, Transform
weave = Weave(Pattern=[0, 1, 2], Stream0=move_5.Geometry, Stream1=move_6.Geometry, Stream2=move_5.Geometry, NullGaps=False)
sub_list = SubList(List=move_4.Geometry, Domain=construct_domain, Wrap=True)  # -> List, Index
list_item = ListItem(List=weave, Index=Slider(7, range=0..100), Wrap=True)
