# Grasshopper definition 20221102_simulation_Two Version Bricks_BR.ghx (Grasshopper 1.0.7)
# plug-ins: treesloth01

# ----
# Make a Brick
B = Base(PlaneXY(0, 0, 0))
division = Division(A="10", B="2")
box = CenterBox(Base=B, X=expr("x/2", "32"), Y=expr("x/2", "15"), Z=expr("x/2", "10"))
Z = UnitZ(Factor=division)
move = Move(Geometry=box, Motion=Z)  # -> Geometry, Transform

number_slider = Slider(100, range=0..100)

ghpython_script = GhPythonScript(file_name="simulation.py")  # -> path
# ---------- ghpython_script: Python ----------
a = ghdoc.Path
b = ghdoc.Name

path = (a[::-1].replace('xhg.'+b[::-1].replace('*','',1),'',1))[::-1]+file_name
# ---------- end ghpython_script ----------
read_file = ReadFile(File=ghpython_script, PerLineParse=False)

panel = Panel("0")
pt = ConstructPoint(XCoordinate="0", YCoordinate=number_slider, ZCoordinate=number_slider)
construct_plane = ConstructPlane(Origin=pt, XAxis=Vector(1, 0, 0), YAxis=Vector(0, 1, 0))

# ---- group: FABRICATION WORKFLOW
python = GhPythonScript(Code=read_file, ROBOT_IP="192.168.10.10", Fabricate=Button(), Debug_plane=construct_plane)  # -> Out, Robot_base_plane, Script, Debug_plane

# ----
toggle_freedrive = GhPythonScript(ip="192.168.10.10", start_teach_mode=Toggle(False), stop_teach_mode=Toggle(False))  # -> a
# ---------- toggle_freedrive: Python ----------
import os
import math

from compas.rpc import Proxy

if start_teach_mode:   
    canvas = ghenv.Component.OnPingDocument()
    path = os.path.abspath(os.path.dirname(canvas.FilePath))
    rtde = Proxy('fabrication', path=path)                         # stay in teach moded(freedrive) as long as this is True
    a = rtde.start_teach_mode(ip=ip)            # send message to robot
    ghenv.Component.Message = "Freedrive on"    # display message on GH component

if stop_teach_mode:   
    canvas = ghenv.Component.OnPingDocument()
    path = os.path.abspath(os.path.dirname(canvas.FilePath))
    rtde = Proxy('fabrication', path=path)                          # stop teach mode if stop button pressed
    a = rtde.stop_teach_mode(ip=ip)             # send message to robot   
    ghenv.Component.Message = "Freedrive off"   # display message on GH component
# ---------- end toggle_freedrive ----------

# ---- group: backup
geometry = Geometry([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])
geometry_2 = Geometry([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])
geometry_3 = Geometry([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])
geometry_4 = Geometry([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])
geometry_5 = Geometry([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])
geometry_6 = Geometry([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])
geometry_7 = Geometry([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])
geometry_8 = Geometry([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])
geometry_9 = Geometry([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])
geometry_10 = Geometry([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])
geometry_11 = Geometry([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])
merge = Merge(
    Data1=geometry,
    Data2=geometry_2,
    Data3=geometry_3,
    Data4=geometry_4,
    Data5=geometry_5,
    Data6=geometry_6,
    Data7=geometry_7,
    Data8=geometry_8,
    Data9=geometry_9,
    Data10=geometry_10,
    Data11=geometry_11)  # -> flatten(Result)

custom_preview = CustomPreview(Geometry=merge, Material=ColourSwatch(SwatchColor=RGBA(232, 0, 0, 249)))

# ---- group: Table
geometry_12 = Geometry(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)

# ---- group: Robot Base
geometry_13 = Geometry(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)

# ---- group: Pickup Station
geometry_14 = Geometry(<mesh referenced from the Rhino model>)

# ---- group: Get robot pose
ghpython_script_2 = GhPythonScript(listen=Toggle(True), robot_base_plane=python.Robot_base_plane)  # -> pose, config
# ---------- ghpython_script_2: Python ----------
import rhinoscriptsyntax as rs
import compas
import compas_rhino
import simple_comm as comm
import Rhino.Geometry as rg

reload(comm)

if listen:
    chunks = comm.listen_to_robot("192.168.10.10")
    config = chunks["actual_joints"]
    pose = chunks["pose"]

    
    
pose = compas.geometry.Frame.from_axis_angle_vector([pose[3],pose[4],pose[5]],[pose[0],pose[1],pose[2]])
pose = compas_rhino.conversions.frame_to_rhino(pose)

x = rg.Transform.PlaneToPlane(robot_base_plane, rg.Plane.WorldXY)

#pose.Transform()
# ---------- end ghpython_script_2 ----------

# ----
# Send planes layer by layer
number_slider_2 = Slider(0, range=0..11)

# ---- group: TODO_Zac
radians = Radians(Degrees=ghpython_script_2.config)
list_item = ListItem(List=radians, Index=0, Wrap=True)  # -> Item, Item1, Item2, Item3, Item4, Item5
ghpython_script_3 = GhPythonScript(x=list_item.Item, y=list_item.Item1, z=list_item.Item2, u=list_item.Item3, v=list_item.Item4, w=list_item.Item5)  # -> configuration
# ---------- ghpython_script_3: Python ----------
import rhinoscriptsyntax as rs

from compas.robots import configuration
from compas_fab.robots import Configuration

configuration = Configuration.from_revolute_values([x,y,z,u,v,w])
# ---------- end ghpython_script_3 ----------
boolean_toggle = BooleanToggle(True)
ur10e = GhPythonScript()  # -> robot
# ---------- ur10e: Python ----------
import os

import compas_fab
from compas.artists import Artist
from compas.geometry import Frame
from compas.robots import RobotModel
from compas.robots.resources import LocalPackageMeshLoader
from compas_fab.backends import AnalyticalInverseKinematics
from compas_fab.backends import OffsetWristKinematics
from compas_fab.backends.interfaces import ClientInterface
from compas_fab.robots import Robot
from compas_fab.robots import RobotSemantics


canvas = ghenv.Component.OnPingDocument()
#
urdf_folder = os.path.join(os.path.dirname(canvas.FilePath), '../dependencies/robots')
#urdf_file = os.path.join(urdf_folder, 'ur10e.urdf')

srdf_file = os.path.join(urdf_folder, 'ur10e.srdf')
#model = RobotModel.from_urdf_file(urdf_file)
#model = RobotModel.from_urdf_file('C:\Zac\GitHub\endless-wall-teamwork\dependencies\ur10.urdf')
urdf_file = compas_fab.get('universal_robot/ur_description/urdf/ur5.urdf')
model = RobotModel.from_urdf_file(urdf_file)

loader = LocalPackageMeshLoader(compas_fab.get('universal_robot'), 'ur_description')
model.load_geometry(loader)

semantics = RobotSemantics.from_srdf_file(srdf_file, model)

client = ClientInterface()
client.is_connected = True
client.inverse_kinematics = AnalyticalInverseKinematics(solver='ur10e')

robot = Robot(model, client=client, semantics=semantics)
robot.artist = Artist(model)
# ---------- end ur10e ----------
robot_visualize = COMPASFABRobotVisualize(
    robot=ur10e,
    configuration=ghpython_script_3,
    show_collision=boolean_toggle,
    show_frames=boolean_toggle,
    show_cm=Toggle(False),
    show_acm=Toggle(False))  # -> visual, collision, collision_meshes, attached_meshes, frames, base_frame, ee_frame; inputs show_visual: Boolean, show_collision: Boolean, show_frames: Boolean, show_base_frame: Boolean, show_end_effector_frame: Boolean, show_cm: Boolean, show_acm: Boolean
#   port group: The planning group used for end-effector and base visualization.
#   port configuration: The robot's full configuration.
#   port show_visual: Whether or not to show the robot's visual meshes.
#   port show_collision: Whether or not to show the robot's collision meshes.
#   port show_frames: Whether or not to show the robot's joint frames.
#   port show_base_frame: Whether or not to show the robot's base frame.
#   port show_end_effector_frame: Whether or not to show the robot's end-effector frame.
#   port show_cm: Whether or not to show the collision meshes (if any).
#   port show_acm: Whether or not to show the attached collision meshes (if any).
#   port visual: Rhino meshes of the robot's visual geometry (if any).
#   port collision: Rhino meshes of the robot's collision geometry (if any).
#   port collision_meshes: Rhino meshes of the scene's collision meshes (if any).
#   port attached_meshes: Rhino meshes of the scene's attached collision meshes (if any).
#   port frames: The robot's joint frames as Rhino planes (if any).
#   port base_frame: The robot's base frame as a Rhino plane (if any).
#   port ee_frame: The robot's end-effector frame as a Rhino plane (if any).
# ---------- robot_visualize: Python ----------
"""
Visualizes the robot.

COMPAS FAB v0.27.0
"""
from compas.artists import Artist
from compas.geometry import Frame
from compas.geometry import Transformation
from compas_fab.robots import PlanningScene
from ghpythonlib.componentbase import executingcomponent as component
import Rhino.Geometry as rg


class RobotVisualize(component):
    def RunScript(
        self,
        robot,
        group,
        configuration,
        show_visual,
        show_collision,
        show_frames,
        show_base_frame,
        show_end_effector_frame,
        show_cm,
        show_acm,
    ):

        visual = None
        collision = None
        collision_meshes = None
        attached_meshes = None
        frames = None
        base_frame = None
        ee_frame = None

        if robot:
            show_visual = True if show_visual is None else show_visual
            show_cm = True if show_cm is None else show_cm
            show_acm = True if show_acm is None else show_acm
            configuration = configuration or robot.zero_configuration()

            robot.update(configuration, visual=show_visual, collision=show_collision)
            compas_frames = robot.transformed_frames(configuration, group)

            if show_visual:
                visual = robot.artist.draw_visual()

            if show_collision:
                collision = robot.artist.draw_collision()

            if show_base_frame:
                base_compas_frame = compas_frames[0]
                artist = Artist(base_compas_frame)
                base_frame = artist.draw()

            if show_end_effector_frame:
                ee_compas_frame = robot.forward_kinematics(
                    configuration, group, options=dict(solver="model")
                )
                artist = Artist(ee_compas_frame)
                ee_frame = artist.draw()

            if show_frames:
                frames = []
                for compas_frame in compas_frames[1:]:
                    artist = Artist(compas_frame)
                    frame = artist.draw()
                    frames.append(frame)

            if show_cm or show_acm:
                scene = PlanningScene(robot)
                scene = robot.client.get_planning_scene()

                collision_meshes = []
                attached_meshes = []

                if show_cm:
                    for co in scene.world.collision_objects:
                        header = co.header
                        frame_id = header.frame_id
                        cms = co.to_collision_meshes()

                        for cm in cms:
                            if cm.frame != Frame.worldXY():
                                t = Transformation.from_frame(cm.frame)
                                mesh = cm.mesh.transformed(t)
                            else:
                                mesh = cm.mesh

                            collision_meshes.append(Artist(mesh).draw())

                if show_acm:
                    for aco in scene.robot_state.attached_collision_objects:
                        for acm in aco.to_attached_collision_meshes():
                            frame_id = aco.object["header"]["frame_id"]
                            frame = robot.forward_kinematics(
                                configuration, options=dict(link=frame_id)
                            )
                            t = Transformation.from_frame(frame)

                            # Local CM frame
                            if (
                                acm.collision_mesh.frame
                                and acm.collision_mesh.frame != Frame.worldXY()
                            ):
                                t = t * Transformation.from_frame(
                                    acm.collision_mesh.frame
                                )

                            mesh = acm.collision_mesh.mesh.transformed(t)

                            attached_meshes.append(Artist(mesh).draw())
#        for v in visual:
#            v.Transform(rg.Transform.Scale(rg.Point3d(0,0,0),10))
        return (
            visual,
            collision,
            collision_meshes,
            attached_meshes,
            frames,
            base_frame,
            ee_frame,
        )
# ---------- end robot_visualize ----------
construct_plane_2 = ConstructPlane(Origin=Point(0, 0, 0), XAxis=Vector(1, 0, 0), YAxis=Vector(0, 1, 0))
scale = Scale(Geometry=robot_visualize.visual, Center=construct_plane_2, Factor="1000")  # -> Geometry, Transform
scale_2 = Scale(Geometry=robot_visualize.frames, Center=construct_plane_2, Factor="1000")  # -> Geometry, Transform
list_item_2 = ListItem(List=scale_2.Geometry, Index=0, Wrap=True)  # -> Item1, Item
deconstruct_plane = DeconstructPlane(Plane=list_item_2.Item1)  # -> Origin, XAxis, YAxis, ZAxis
unit_vector = UnitVector(Vector=deconstruct_plane.ZAxis)
multiplication = Multiplication(A=unit_vector, B="80")
move_2 = Move(Geometry=list_item_2.Item1, Motion=multiplication)  # -> Geometry, Transform
construct_plane_3 = ConstructPlane(Origin=move_2.Geometry, XAxis=Vector(1, 0, 0), YAxis=Vector(0, 1, 0))
rotate = Rotate(Geometry=construct_plane_3, Angle=1.570796327, Plane=construct_plane_3)  # -> Geometry, Transform
orient = Orient(Geometry=scale.Geometry, Source=rotate.Geometry, Target=python.Debug_plane)  # -> Geometry, Transform

# ----
Y = UnitY(Factor=1)
rot3d = Rotate3D(Geometry=B, Angle=degrees("90"), Center=Point(0, 0, 0), Axis=Y)  # -> Geometry, Transform
box_2 = CenterBox(Base=rot3d.Geometry, X=expr("x/2", "32"), Y=expr("x/2", "15"), Z=expr("x/2", "10"))
debrep = DeconstructBrep(Brep=box)  # -> Faces, Edges, Vertices
debrep_2 = DeconstructBrep(Brep=box_2)  # -> Faces, Edges, Vertices
item = ListItem(List=debrep.Vertices, Index="1", Wrap=True)
item_2 = ListItem(List=debrep_2.Vertices, Index="1", Wrap=True)
vec2pt = Vector2Pt(PointA=item_2, PointB=item, Unitize=False)  # -> Vector, Length
move_3 = Move(Geometry=rot3d.Geometry, Motion=vec2pt.Vector)  # -> Geometry, Transform
merge_2 = Merge(Data1=B, Data2=move_3.Geometry)
Y_2 = UnitY(Factor=1)
rot3d_2 = Rotate3D(Geometry=merge_2, Angle=degrees("45"), Center=Point(0, 0, 0), Axis=Y_2)  # -> simplify(Geometry), Transform
series = Series(Start=0, Step="45.25", Count=10)
renumber = RenumberPaths(Data=rot3d_2.Geometry)
X = UnitX(Factor=series)
series_2 = Series(Start=0, Step="14.14", Count=Slider(12, range=0..100))  # -> graft(Series)
move_4 = Move(Geometry=renumber, Motion=X)  # -> Geometry, Transform
Z_2 = UnitZ(Factor=series_2)
flip = FlipMatrix(Data=move_4.Geometry)  # -> reverse(simplify(Data))
item_3 = ListItem(List=flip, Index="1", Wrap=True)
item_4 = ListItem(List=flip, Index=0, Wrap=True)
deplane = DeconstructPlane(Plane=item_4)  # -> Origin, XAxis, YAxis, ZAxis
neg = Negative(Value=deplane.XAxis)
pl = ConstructPlane(Origin=deplane.Origin, XAxis=neg, YAxis=deplane.YAxis)
merge_3 = Merge(Data1=pl, Data2=item_3)
flatten = FlattenTree(Tree=merge_3, Path="{0}")
move_5 = Move(Geometry=flatten, Motion=Z_2)  # -> flatten(Geometry), Transform
plnaxis = PlaneAxis(P=move_5.Geometry, B=35)
points = PointList(Points=move_5.Geometry, Size=Slider(9, range=0..100))
box_3 = CenterBox(Base=move_5.Geometry, X=expr("x/2", "32"), Y=expr("x/2", "15"), Z=expr("x/2", "10"))
series_3 = Series(Start=0, Step=1, Count=Slider(240, range=1..240))
item_5 = ListItem(List=box_3, Index=series_3, Wrap=True)

deplane_2 = DeconstructPlane(Plane=move_5.Geometry)  # -> Origin, XAxis, YAxis, ZAxis
lng = ListLength(List=box_3)
first_last = FirstLast(List=item_5)  # -> FirstValue, LastValue
panel_3 = Panel(lng)
preview = CustomPreview(Geometry=first_last.LastValue, Material=ColourSwatch(SwatchColor=RGB(255, 255, 255)))

# ----
# Brick Wall_Version 1
number_slider_3 = Slider(173, range=0..1000)
cir = Circle(Plane=PlaneXY(0, 0, 0), Radius=number_slider_3)
series_4 = Series(Start=0, Step="10", Count=Slider(12, range=0..100))
multiplication_2 = Multiplication(A=number_slider_3, B=Slider(2, range=0..10))
Z_3 = UnitZ(Factor=series_4)
panel_4 = Panel(multiplication_2)
move_6 = Move(Geometry=cir, Motion=Z_3)  # -> simplify(Geometry), Transform
dom = ConstructDomain(DomainStart=0, DomainEnd=Slider(45, range=0..180))
number_slider_4 = Slider(60, range=0..100)
range = Range(Domain=dom, Steps=expr("x-1", "30"))
dispatch = Dispatch(List=move_6.Geometry, DispatchPattern=[True, False])  # -> ListA, ListB
graph = GraphMapper(range, x0=0, x1=45, y0=0, y1=45, container_name="Sine", Equation_px=[0, 0.5064998269], Equation_py=[0, 1])
division_2 = Division(A=number_slider_4, B="2")
hframes = HorizontalFrames(Curve=dispatch.ListA, Count=number_slider_4)  # -> Frames, Parameters
hframes_2 = HorizontalFrames(Curve=dispatch.ListB, Count=number_slider_4)  # -> Frames, Parameters
panel_5 = Panel(division_2)
dispatch_2 = Dispatch(List=hframes.Frames, DispatchPattern=[True, False])  # -> ListA, ListB
dispatch_3 = Dispatch(List=hframes_2.Frames, DispatchPattern=[True, False])  # -> ListA, ListB
pln = Plane(simplify(dispatch_2.ListA))
pln_2 = Plane(simplify(dispatch_3.ListB))
prot = RotatePlane(Plane=pln_2, Angle=degrees(graph))  # -> simplify(Plane)
neg_2 = Negative(Value=graph)
prot_2 = RotatePlane(Plane=pln, Angle=degrees(neg_2))  # -> simplify(Plane)
path_mapper = PathMapper(prot, source="(A)", target="(A;+1)")
merge_4 = Merge(Data1=prot_2, Data2=path_mapper)  # -> simplify(Result)
series_5 = Series(Start=0, Step="12", Count="12")  # -> graft(Series)
pt_2 = ConstructPoint(XCoordinate=0, YCoordinate=0, ZCoordinate=0)
rotate_2 = Rotate(Geometry=merge_4, Angle=degrees(series_5), Plane=pt_2)  # -> Geometry, Transform
renumber_2 = RenumberPaths(Data=rotate_2.Geometry)
Z_4 = UnitZ(Factor="10")
move_7 = Move(Geometry=renumber_2, Motion=Z_4)  # -> Geometry, Transform
tstat = TreeStatistics(Tree=move_7.Geometry)  # -> Paths, Length, Count
flatten_2 = FlattenTree(Tree=move_7.Geometry, Path="{0}")
lng_2 = ListLength(List=flatten_2)
branch = TreeBranch(Tree=move_7.Geometry, Path=number_slider_2, MaintainPaths=True)
series_6 = Series(Start=0, Step=1, Count=lng_2)
gradient = Gradient(
    LowerLimit=0,
    UpperLimit=lng_2,
    Parameter=series_6,
    stops=[0: RGB(234, 38, 0), 0.25: RGB(234, 126, 0), 0.5: RGB(254, 244, 84), 0.75: RGB(173, 203, 249), 1: RGB(75, 107, 169)])
X_2 = UnitX(Factor=Slider(186, range=0..1000))
Z_5 = UnitZ(Factor="9")
Y_3 = UnitY(Factor=Slider(186, range=0..1000))
geo = Geometry(flatten(branch))
addition = Addition(B=X_2, C=Y_3)
pln_3 = Plane(geo)
move_8 = Move(Geometry=pln_3, Motion=addition)  # -> Geometry, Transform
preview_2 = CustomPreview(Geometry=flatten_2, Material=gradient)

# ----
# Brick Visualization
orient_2 = Orient(Geometry=move.Geometry, Source=B, Target=flatten_2)  # -> Geometry, Transform

# ----
# Export Plane
rotate_3 = Rotate(Geometry=move_8.Geometry, Angle=0, Plane=move_8.Geometry)  # -> Geometry, Transform

preview_3 = CustomPreview(Geometry=orient_2.Geometry, Material=ColourSwatch(SwatchColor=RGB(255, 255, 255)))
points_2 = PointList(Points=rotate_3.Geometry, Size=Slider(9, range=0..100))

# ==== cluster PlaneAxis: show plane X Y Z axis.
P = ClusterInput()
B = ClusterInput()
deplane = DeconstructPlane(Plane=graft(P))  # -> Origin, XAxis, YAxis, ZAxis
multiplication = Multiplication(A=[deplane.XAxis, deplane.YAxis, deplane.ZAxis], B=B)
vdisex = VectorDisplayEx(
    Point=deplane.Origin,
    Vector=multiplication,
    Colour=[ColourSwatch(SwatchColor=RGB(235, 52, 52)), ColourSwatch(SwatchColor=RGB(90, 207, 48)), ColourSwatch(SwatchColor=RGB(54, 126, 227))],
    Width=2)
