# Grasshopper definition 20221107_demo_v2_BR.gh (Grasshopper 1.0.7)
# plug-ins: treesloth01, Noise 4D

# ----
# Make a Brick
panel = Panel("2")
B = Base(PlaneXY(0, 0, 0))
division = Division(A="10", B=panel)
box = CenterBox(Base=B, X=expr("x/2", "32"), Y=expr("x/2", "15.5"), Z=expr("x/2", "10"))
Z = UnitZ(Factor=division)
move = Move(Geometry=box, Motion=Z)  # -> Geometry, Transform

number_slider = Slider(175, range=0..1000)
P = Plane(PlaneXY(0, 0, 0))
range = Range(Domain=Domain(0, 1), Steps=Slider(40, range=0..100))
deplane = DeconstructPlane(Plane=P)  # -> Origin, XAxis, YAxis, ZAxis
cir = Circle(Plane=P, Radius=number_slider)
graph = GraphMapper(
    range,
    x0=0,
    x1=1,
    y0=0,
    y1=1,
    container_name="Sine",
    Equation_px=[0.007785962895, 0.2544272542],
    Equation_py=[0.4870889783, 1])
shift = ShiftList(List=graph, Shift="-1", Wrap=invert(True))
ma = MassAddition(Input=shift)  # -> Result, PartialResults
bnd = Bounds(Numbers=ma.PartialResults)
remap = RemapNumbers(Value=ma.PartialResults, Source=bnd, Target=Domain(0, 1))  # -> Mapped, Clipped
eval = EvaluateLength(Curve=cir, Length=remap.Mapped, Normalized=True)  # -> Point, Tangent, Parameter
pl = PlaneNormal(Origin=eval.Point, ZAxis=Vector(0, 0, 1))
shatter = Shatter(Curve=cir, Parameters=eval.Parameter)
curvepoint = PointOnCurve(shatter, parameter=0.5)
deplane_2 = DeconstructPlane(Plane=pl)  # -> Origin, XAxis, YAxis, ZAxis
orient = Orient(Geometry=move.Geometry, Source=B, Target=pl)  # -> Geometry, Transform
move_2 = Move(Geometry=curvepoint, Motion=Vector(0, 0, 10))  # -> Geometry, Transform
deplane_3 = DeconstructPlane(Plane=move_2.Geometry)  # -> Origin, XAxis, YAxis, ZAxis
orient_2 = Orient(Geometry=move.Geometry, Source=B, Target=move_2.Geometry)  # -> Geometry, Transform

number_slider_2 = Slider(15, range=0..100)  # disabled
number_slider_3 = Slider(2, range=0..10)  # disabled
number_slider_4 = Slider(12, range=0..100)  # disabled
number_slider_5 = Slider(45, range=0..180)  # disabled
series = Series(Start=0, Step=number_slider_2, Count=number_slider_4)  # disabled
multiplication = Multiplication(A=number_slider, B=number_slider_3)  # disabled
Z_2 = UnitZ(Factor=series)  # disabled
panel_2 = Panel(multiplication)  # disabled
number_slider_6 = Slider(100, range=0..120)  # disabled
move_3 = Move(Geometry=cir, Motion=Z_2)  # -> simplify(Geometry), Transform; disabled
dom = ConstructDomain(DomainStart=0, DomainEnd=number_slider_5)  # disabled
panel_3 = Panel("30")  # disabled
pt = Point(eval.Point)
range_2 = Range(Domain=dom, Steps=expr("x-1", panel_3))  # disabled
dispatch = Dispatch(List=move_3.Geometry, DispatchPattern=[True, False])  # -> ListA, ListB; disabled
panel_4 = Panel("2")  # disabled
graph_2 = GraphMapper(range_2, x0=0, x1=45, y0=0, y1=45, container_name="Sine", Equation_px=[0, 0.5064998269], Equation_py=[0, 1])  # disabled
division_2 = Division(A=number_slider_6, B=panel_4)  # disabled
hframes = HorizontalFrames(Curve=dispatch.ListA, Count=number_slider_6)  # -> Frames, Parameters; disabled
hframes_2 = HorizontalFrames(Curve=dispatch.ListB, Count=number_slider_6)  # -> Frames, Parameters; disabled
panel_5 = Panel(division_2)  # disabled
dispatch_2 = Dispatch(List=hframes.Frames, DispatchPattern=[True, False])  # -> ListA, ListB; disabled
dispatch_3 = Dispatch(List=hframes_2.Frames, DispatchPattern=[True, False])  # -> ListA, ListB; disabled
pln = Plane(simplify(dispatch_3.ListB))  # disabled
pln_2 = Plane(simplify(dispatch_2.ListA))  # disabled
prot = RotatePlane(Plane=pln, Angle=degrees(graph_2))  # -> simplify(Plane); disabled
merge = Merge(Data1=pln_2, Data2=pln)  # -> simplify(Result); disabled

# ---- group: Brick rotate globally
neg = Negative(Value=Slider(15, range=0..100))
rot3d = Rotate3D(Geometry=orient.Geometry, Angle=degrees(neg), Center=deplane.Origin, Axis=deplane.YAxis)  # -> Geometry, Transform
rot3d_2 = Rotate3D(Geometry=orient_2.Geometry, Angle=degrees(neg), Center=deplane.Origin, Axis=deplane.YAxis)  # -> Geometry, Transform
merge_2 = Merge(Data1=rot3d_2.Geometry, Data2=rot3d.Geometry)  # -> flatten(Result)
series_2 = Series(Start=0, Step=Slider(20.7, range=0..100), Count=10)  # -> graft(Series)
Z_3 = UnitZ(Factor=series_2)
move_4 = Move(Geometry=merge_2, Motion=Z_3)  # -> Geometry, Transform

# ---- group: Bricks rotate individually.
neg_2 = Negative(Value=Slider(15, range=0..100))
rot3d_3 = Rotate3D(Geometry=orient.Geometry, Angle=degrees(neg_2), Center=deplane_2.Origin, Axis=deplane_2.YAxis)  # -> Geometry, Transform
rot3d_4 = Rotate3D(Geometry=orient_2.Geometry, Angle=degrees(neg_2), Center=deplane_3.Origin, Axis=deplane_3.YAxis)  # -> Geometry, Transform
merge_3 = Merge(Data1=rot3d_4.Geometry, Data2=rot3d_3.Geometry)  # -> flatten(Result)
series_3 = Series(Start=0, Step=Slider(21.3, range=0..100), Count=10)  # -> graft(Series)
Z_4 = UnitZ(Factor=series_3)
move_5 = Move(Geometry=merge_3, Motion=Z_4)  # -> Geometry, Transform

# ----
neg_3 = Negative(Value=graph_2)  # disabled
path_mapper = PathMapper(prot, source="(A)", target="(A;+1)")  # disabled
prot_2 = RotatePlane(Plane=pln_2, Angle=degrees(neg_3))  # -> simplify(Plane); disabled
panel_6 = Panel("12")  # disabled
merge_4 = Merge(Data1=prot_2, Data2=path_mapper)  # -> simplify(Result); disabled
series_4 = Series(Start=0, Step=panel_6, Count=panel_6)  # -> graft(Series); disabled
pt_2 = ConstructPoint(XCoordinate=0, YCoordinate=0, ZCoordinate=0)  # disabled
rotate = Rotate(Geometry=merge_4, Angle=degrees(series_4), Plane=pt_2)  # -> Geometry, Transform; disabled
renumber = RenumberPaths(Data=rotate.Geometry)  # disabled
panel_7 = Panel("10")  # disabled
Z_5 = UnitZ(Factor=panel_7)  # disabled
move_6 = Move(Geometry=renumber, Motion=Z_5)  # -> Geometry, Transform; disabled
tstat = TreeStatistics(Tree=move_6.Geometry)  # -> Paths, Length, Count; disabled
flatten = FlattenTree(Tree=move_6.Geometry, Path="{0}")  # disabled

# ----
# Send planes layer by layer
number_slider_7 = Slider(11, range=0..11)  # disabled

volume = Volume(Geometry=move_4.Geometry)  # -> Volume, Centroid
orient_3 = Orient(Geometry=move.Geometry, Source=B, Target=flatten)  # -> Geometry, Transform; disabled
lng = ListLength(List=flatten)  # disabled
pdecon = Deconstruct(Point=volume.Centroid)  # -> XComponent, YComponent, ZComponent
flatten_2 = FlattenTree(Tree=pdecon.ZComponent, Path="{0}")
flatten_3 = FlattenTree(Tree=move_4.Geometry, Path="{0}")

# ----
# Circle Brick_Diagonal
xy = XYPlane(Origin=Point(0, 0, 0))  # disabled
deplane_4 = DeconstructPlane(Plane=xy)  # -> Origin, XAxis, YAxis, ZAxis; disabled
deplane_5 = DeconstructPlane(Plane=merge)  # -> Origin, XAxis, YAxis, ZAxis; disabled
panel_8 = Panel("-15")  # disabled
xy_2 = XYPlane(Origin=Point(0, 0, 0))  # disabled
rot3d_5 = Rotate3D(Geometry=merge, Angle=degrees(panel_8), Center=deplane_5.Origin, Axis=deplane_4.XAxis)  # -> Geometry, Transform; disabled
deplane_6 = DeconstructPlane(Plane=xy_2)  # -> Origin, XAxis, YAxis, ZAxis; disabled
align = AlignPlane(Plane=rot3d_5.Geometry, Direction=deplane_6.YAxis)  # -> Plane, Angle; disabled
orient_4 = Orient(Geometry=move.Geometry, Source=B, Target=align.Plane)  # -> Geometry, Transform; disabled

branch = TreeBranch(Tree=move_6.Geometry, Path=number_slider_7, MaintainPaths=True)  # disabled
series_5 = Series(Start=0, Step=1, Count=lng)  # disabled
number_slider_8 = Slider(186, range=0..1000)  # disabled
number_slider_9 = Slider(186, range=0..1000)  # disabled
sort = SortList(Keys=flatten_2, ValuesA=flatten_3)  # -> Keys, ValuesA
gradient = Gradient(
    LowerLimit=0,
    UpperLimit=lng,
    Parameter=series_5,
    stops=[0: RGB(234, 38, 0), 0.25: RGB(234, 126, 0), 0.5: RGB(254, 244, 84), 0.75: RGB(173, 203, 249), 1: RGB(75, 107, 169)])  # disabled
panel_9 = Panel("9")  # disabled
X = UnitX(Factor=number_slider_9)  # disabled
Z_6 = UnitZ(Factor=panel_9)  # disabled
Y = UnitY(Factor=number_slider_8)  # disabled
geo = Geometry(flatten(branch))  # disabled
larger = LargerThan(FirstNumber=sort.Keys, SecondNumber=Slider(100, range=0..100))  # -> LargerThan, OrEqualTo
number_slider_10 = Slider(2, range=0..10)  # disabled
addition = Addition(B=X, C=Y)  # disabled
pln_3 = Plane(geo)  # disabled
dispatch_4 = Dispatch(List=sort.ValuesA, DispatchPattern=larger.LargerThan)  # -> ListA, ListB
number_slider_11 = Slider(15, range=0..100)  # disabled
move_7 = Move(Geometry=pln_3, Motion=addition)  # -> Geometry, Transform; disabled
preview = CustomPreview(Geometry=flatten, Material=gradient)  # disabled
geo_2 = Geometry(dispatch_4.ListA)
panel_10 = Panel("-90")  # disabled
number_slider_12 = Slider(23, range=0..100)  # disabled
lng_2 = ListLength(List=geo_2)

# ----
# Export Plane
rotate_2 = Rotate(Geometry=move_7.Geometry, Angle=0, Plane=move_7.Geometry)  # -> Geometry, Transform; disabled

neg_4 = Negative(Value=number_slider_10)  # disabled
rotate_3 = Rotate(Geometry=move_7.Geometry, Angle=degrees(panel_10), Plane=move_7.Geometry)  # -> Geometry, Transform; disabled
series_6 = Series(Start=0, Step=1, Count=Slider(374, range=1..407))
panel_11 = Panel(lng_2)
item = ListItem(List=rotate_3.Geometry, Index=number_slider_11, Wrap=True)  # disabled
Z_7 = UnitZ(Factor=neg_4)  # disabled
item_2 = ListItem(List=geo_2, Index=series_6, Wrap=True)
points = PointList(Points=rotate_3.Geometry, Size=number_slider_12)  # disabled
plnaxis = PlaneAxis(P=rotate_3.Geometry, B=35)  # disabled
move_8 = Move(Geometry=item, Motion=Z_7)  # -> Geometry, Transform; disabled

# ---- group: backup
geo_3 = Geometry([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])  # disabled
geo_4 = Geometry([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])  # disabled
geo_5 = Geometry([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])  # disabled
geo_6 = Geometry([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])  # disabled
geo_7 = Geometry([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])  # disabled
geo_8 = Geometry([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])  # disabled
geo_9 = Geometry([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])  # disabled
geo_10 = Geometry([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])  # disabled
geo_11 = Geometry([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])  # disabled
geo_12 = Geometry([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])  # disabled
geo_13 = Geometry([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])  # disabled
merge_5 = Merge(
    Data1=geo_3,
    Data2=geo_4,
    Data3=geo_5,
    Data4=geo_6,
    Data5=geo_7,
    Data6=geo_8,
    Data7=geo_9,
    Data8=geo_10,
    Data9=geo_11,
    Data10=geo_12,
    Data11=geo_13)  # -> flatten(Result); disabled

# ----
# Brick Visualization
orient_5 = Orient(Geometry=move.Geometry, Source=B, Target=rotate_2.Geometry)  # -> Geometry, Transform; disabled

panel_12 = Panel("334")  # disabled
panel_13 = Panel("305")  # disabled

panel_14 = Panel("simulation.py")  # disabled
python = GhPythonScript(file_name=panel_14)  # -> path; disabled
# ---------- python: Python ----------
a = ghdoc.Path
b = ghdoc.Name

path = (a[::-1].replace('xhg.'+b[::-1].replace('*','',1),'',1))[::-1]+file_name
# ---------- end python ----------
file = ReadFile(File=python, PerLineParse=False)  # disabled

panel_15 = Panel("0")  # disabled
panel_16 = Panel("0")  # disabled
panel_17 = Panel("0")  # disabled
panel_18 = Panel("29")  # disabled
dom_2 = ConstructDomain(DomainStart=panel_13, DomainEnd=panel_12)  # disabled
geo_14 = Geometry([Plane(origin=(130.5129571, 928.2940481, 95.29507717), x=(0.8660254069, 0, 0.4999999947), y=(-0.2499999971, 0.866025404, 0.4330127031)), Plane(origin=(112.6329571, 928.2940481, 95.29507717), x=(0.8660254069, 0, 0.4999999947), y=(-0.2499999971, 0.866025404, 0.4330127031)), Plane(origin=(94.75295712, 928.2940481, 95.29507717), x=(0.8660254069, 0, 0.4999999947), y=(-0.2499999971, 0.866025404, 0.4330127031)), Plane(origin=(76.87295712, 928.2940481, 95.29507717), x=(0.8660254069, 0, 0.4999999947), y=(-0.2499999971, 0.866025404, 0.4330127031)), Plane(origin=(138.512957, 900.5812352, 81.43867067), x=(0.8660254069, 0, 0.4999999947), y=(-0.2499999971, 0.866025404, 0.4330127031)), Plane(origin=(120.632957, 900.5812352, 81.43867067), x=(0.8660254069, 0, 0.4999999947), y=(-0.2499999971, 0.866025404, 0.4330127031))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])  # disabled
panel_19 = Panel(move_8.Geometry)  # disabled
preview_2 = CustomPreview(Geometry=item_2, Material=ColourSwatch(SwatchColor=RGB(255, 94, 94)))
pt_3 = ConstructPoint(XCoordinate=panel_15, YCoordinate=panel_16, ZCoordinate=panel_17)  # disabled
range_3 = Range(Domain=dom_2, Steps=panel_18)  # disabled
partition = PartitionList(List=geo_14, Size=[30, 30])  # -> simplify(Chunks); disabled

# ---- group: backup
swatch = ColourSwatch(SwatchColor=RGBA(232, 0, 0, 249))  # disabled
preview_3 = CustomPreview(Geometry=merge_5, Material=swatch)  # disabled

# ----
pl_2 = ConstructPlane(Origin=pt_3, XAxis=Vector(1, 0, 0), YAxis=Vector(0, 1, 0))  # disabled
item_3 = ListItem(List=geo_14, Index=range_3, Wrap=True)  # disabled
branch_2 = TreeBranch(Tree=partition, Path=number_slider_7, MaintainPaths=True)  # disabled
item_4 = ListItem(List=branch_2, Index=0, Wrap=True)  # disabled
item_5 = ListItem(List=merge_5, Index=0, Wrap=True)  # disabled
item_6 = ListItem(List=merge_5, Index=0, Wrap=True)  # disabled
panel_20 = Panel("192.168.10.10")  # disabled

# ---- group: FABRICATION WORKFLOW
button = Button()  # disabled
python_2 = GhPythonScript(Code=file, ROBOT_IP=panel_20, Fabricate=button, Debug_plane=move_8.Geometry)  # -> Out, Robot_base_plane, Script, Debug_plane; disabled

# ----
toggle = BooleanToggle(False)  # disabled
toggle_2 = BooleanToggle(False)  # disabled
toggle_freedrive = GhPythonScript(ip=panel_20, start_teach_mode=toggle, stop_teach_mode=toggle_2)  # -> a; disabled
# ---------- toggle_freedrive: Python ----------
import os
import math

from compas.rpc import Proxy

if start_teach_mode:   
    canvas = ghenv.Component.OnPingDocument()
    path = os.path.abspath(os.path.dirname(canvas.FilePath))
    rtde = Proxy('fabrication', path=path)                         # stay in teach moded(freedrive) as long as this is True
    a = rtde.start_teach_mode(ip=ip)            # send message to robot
    ghenv.Component.Message = "Freedrive on"    # display message on GH component

if stop_teach_mode:   
    canvas = ghenv.Component.OnPingDocument()
    path = os.path.abspath(os.path.dirname(canvas.FilePath))
    rtde = Proxy('fabrication', path=path)                          # stop teach mode if stop button pressed
    a = rtde.stop_teach_mode(ip=ip)             # send message to robot   
    ghenv.Component.Message = "Freedrive off"   # display message on GH component
# ---------- end toggle_freedrive ----------

debrep = DeconstructBrep(Brep=item_5)  # -> Faces, Edges, Vertices; disabled
number_slider_13 = Slider(5, range=0..10)  # disabled
item_7 = ListItem(List=debrep.Faces, Index=number_slider_13, Wrap=True)  # disabled
panel_21 = Panel(python_2.Out)  # disabled
deplane_7 = DeconstructPlane(Plane=item_7)  # -> Origin, XAxis, YAxis, ZAxis; disabled

# ---- group: Table
geo_15 = Geometry(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)  # disabled

# ---- group: Robot Base
geo_16 = Geometry(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)  # disabled

# ---- group: Pickup Station
geo_17 = Geometry(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)  # disabled

# ----
item_8 = ListItem(List=debrep.Vertices, Index=0, Wrap=True)  # -> Item, Item1, Item2, Item3, Item4, Item5, Item6, Item7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; disabled
panel_22 = Panel("robot_listen.py")  # disabled
geo_18 = Geometry(item_8.Item4)  # disabled
python_3 = GhPythonScript(file_name=panel_22)  # -> path; disabled; same code as python
vec2pt = Vector2Pt(PointA=deplane_7.Origin, PointB=item_8.Item6, Unitize=False)  # -> Vector, Length; disabled
vec2pt_2 = Vector2Pt(PointA=deplane_7.Origin, PointB=item_8.Item4, Unitize=False)  # -> Vector, Length; disabled
multiplication_2 = Multiplication(A=vec2pt.Vector, B=0.5)  # disabled
multiplication_3 = Multiplication(A=vec2pt_2.Vector, B=0.5)  # disabled
toggle_3 = BooleanToggle(True)  # disabled
toggle_4 = BooleanToggle(True)  # disabled
file_2 = ReadFile(File=python_3, PerLineParse=False)  # disabled
addition_2 = Addition(A=multiplication_2, B=multiplication_3)  # disabled
move_9 = Move(Geometry=deplane_7.Origin, Motion=addition_2)  # -> Geometry, Transform; disabled

# ---- group: Get robot pose
python_4 = GhPythonScript(Code=file_2, Listen=toggle_4, Robot_base_plane=python_2.Robot_base_plane)  # -> Out, Pose, Config; disabled

# ----
python_5 = GhPythonScript(button=toggle_3, ROBOT_IP=panel_20)  # -> out, a; disabled
# ---------- python_5: Python ----------
from imp import reload
import Rhino.Geometry as rg
import simple_ur_script as ur
reload(ur)
import simple_comm as c
reload(c)
import math as m
from compas.geometry import Frame
from compas_rhino.conversions import frame_to_rhino

def tcp(script):
    # script += ur.set_tcp_by_angles(-0.35, 0.5, 89.08, m.radians(0.0), m.radians(3.1415),m.radians(0.0))
    # script += ur.set_tcp_by_angles(-0.35, 0.5, 89.08, m.radians(0.0), m.radians(0),m.radians(0.0))
    script += ur.set_tcp_by_angles(-0.35, 0.5, 89.08, 0.0, 3.1415, 1.57)
    
    return script
def send(script):
    script = c.concatenate_script(script)
    c.send_script(script, ROBOT_IP)
    return script 
    
    
    
script = ''
if button:
    script = tcp(script)
    send (script)
# ---------- end python_5 ----------
pl_3 = ConstructPlane(Origin=move_9.Geometry, XAxis=deplane_7.YAxis, YAxis=expr("-x", deplane_7.XAxis))  # disabled
deplane_8 = DeconstructPlane(Plane=pl_3)  # -> Origin, XAxis, YAxis, ZAxis; disabled
geo_19 = Geometry(Plane(origin=(130.5129571, 928.2940481, 95.29507717), x=(0.8986609222, -0.1455916388, 0.4137772608), y=(-0.03696385885, 0.9148193651, 0.4021681271)))  # disabled
deplane_9 = DeconstructPlane(Plane=geo_19)  # -> Origin, XAxis, YAxis, ZAxis; disabled
orient_6 = Orient(Geometry=merge_5, Source=pl_3, Target=geo_19)  # -> Geometry, Transform; disabled
panel_23 = Panel(python_4.Out)  # disabled
rad = Radians(Degrees=python_4.Config)  # disabled
vec2pt_3 = Vector2Pt(PointA=deplane_8.Origin, PointB=deplane_9.Origin, Unitize=False)  # -> Vector, Length; disabled
geo_20 = Geometry()  # disabled
move_10 = Move(Geometry=pl_3, Motion=vec2pt_3.Vector)  # -> Geometry, Transform; disabled
item_9 = ListItem(List=rad, Index=0, Wrap=True)  # -> Item, Item1, Item2, Item3, Item4, Item5; disabled
number_slider_14 = Slider(9, range=0..10)  # disabled
geo_21 = Geometry(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)  # disabled
geo_22 = Geometry([Plane(origin=(4326.842561, 496.4232481, 95.07750284), x=(0.8660254069, 0, 0.4999999947), y=(-0.2499999971, 0.866025404, 0.4330127031)), Plane(origin=(4308.962561, 496.4232481, 95.07750284), x=(0.8660254069, 0, 0.4999999947), y=(-0.2499999971, 0.866025404, 0.4330127031)), Plane(origin=(4291.082561, 496.4232481, 95.07750284), x=(0.8660254069, 0, 0.4999999947), y=(-0.2499999971, 0.866025404, 0.4330127031)), Plane(origin=(4273.202561, 496.4232481, 95.07750284), x=(0.8660254069, 0, 0.4999999947), y=(-0.2499999971, 0.866025404, 0.4330127031)), Plane(origin=(4334.842561, 468.7104352, 81.22109634), x=(0.8660254069, 0, 0.4999999947), y=(-0.2499999971, 0.866025404, 0.4330127031)), Plane(origin=(4316.962561, 468.7104352, 81.22109634), x=(0.8660254069, 0, 0.4999999947), y=(-0.2499999971, 0.866025404, 0.4330127031))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])  # disabled
python_6 = GhPythonScript(x=item_9.Item, y=item_9.Item1, z=item_9.Item2, u=item_9.Item3, v=item_9.Item4, w=item_9.Item5)  # -> configuration; disabled
# ---------- python_6: Python ----------
import rhinoscriptsyntax as rs

from compas.robots import configuration
from compas_fab.robots import Configuration

configuration = Configuration.from_revolute_values([x,y,z,u,v,w])
# ---------- end python_6 ----------
orient_7 = Orient(Geometry=geo_21, Source=pl_3, Target=move_10.Geometry)  # -> Geometry, Transform; disabled
orient_8 = Orient(Geometry=geo_22, Source=pl_3, Target=move_10.Geometry)  # -> Geometry, Transform; disabled
orient_9 = Orient(Geometry=merge_5, Source=pl_3, Target=move_10.Geometry)  # -> simplify(Geometry), Transform; disabled
panel_24 = Panel("3")  # disabled
toggle_5 = BooleanToggle(True)  # disabled
preview_4 = CustomPreview(
    Geometry=orient_7.Geometry,
    Material={diffuse=RGB(221, 160, 221), emission=RGB(66, 48, 66), shine=0.5, specular=RGB(255, 255, 255), transparency=0})  # disabled
toggle_6 = BooleanToggle(False)  # disabled
toggle_7 = BooleanToggle(False)  # disabled
panel_25 = Panel("305")  # disabled
panel_26 = Panel("334")  # disabled
partition_2 = PartitionList(List=orient_9.Geometry, Size=[30, 30])  # -> simplify(Chunks); disabled
ur10e = GhPythonScript()  # -> robot; disabled
# ---------- ur10e: Python ----------
import os

import compas_fab
from compas.artists import Artist
from compas.geometry import Frame
from compas.robots import RobotModel
from compas.robots.resources import LocalPackageMeshLoader
from compas_fab.backends import AnalyticalInverseKinematics
from compas_fab.backends import OffsetWristKinematics
from compas_fab.backends.interfaces import ClientInterface
from compas_fab.robots import Robot
from compas_fab.robots import RobotSemantics


canvas = ghenv.Component.OnPingDocument()
#
urdf_folder = os.path.join(os.path.dirname(canvas.FilePath), '../dependencies/robots')
#urdf_file = os.path.join(urdf_folder, 'ur10e.urdf')

srdf_file = os.path.join(urdf_folder, 'ur10e.srdf')
#model = RobotModel.from_urdf_file(urdf_file)
#model = RobotModel.from_urdf_file('C:\Zac\GitHub\endless-wall-teamwork\dependencies\ur10.urdf')
urdf_file = compas_fab.get('universal_robot/ur_description/urdf/ur5.urdf')
model = RobotModel.from_urdf_file(urdf_file)

loader = LocalPackageMeshLoader(compas_fab.get('universal_robot'), 'ur_description')
model.load_geometry(loader)

semantics = RobotSemantics.from_srdf_file(srdf_file, model)

client = ClientInterface()
client.is_connected = True
client.inverse_kinematics = AnalyticalInverseKinematics(solver='ur10e')

robot = Robot(model, client=client, semantics=semantics)
robot.artist = Artist(model)
# ---------- end ur10e ----------
series_7 = Series(Start=panel_24, Step=1, Count=number_slider_14)  # disabled
dom_3 = ConstructDomain(DomainStart=panel_25, DomainEnd=panel_26)  # disabled
panel_27 = Panel("29")  # disabled
branch_3 = TreeBranch(Tree=partition_2, Path=series_7, MaintainPaths=True)  # disabled
robot_visualize = COMPASFABRobotVisualize(robot=ur10e, configuration=python_6, show_collision=toggle_5, show_frames=toggle_5, show_cm=toggle_6, show_acm=toggle_7)  # -> visual, collision, collision_meshes, attached_meshes, frames, base_frame, ee_frame; inputs show_visual: Boolean, show_collision: Boolean, show_frames: Boolean, show_base_frame: Boolean, show_end_effector_frame: Boolean, show_cm: Boolean, show_acm: Boolean; disabled
#   port group: The planning group used for end-effector and base visualization.
#   port configuration: The robot's full configuration.
#   port show_visual: Whether or not to show the robot's visual meshes.
#   port show_collision: Whether or not to show the robot's collision meshes.
#   port show_frames: Whether or not to show the robot's joint frames.
#   port show_base_frame: Whether or not to show the robot's base frame.
#   port show_end_effector_frame: Whether or not to show the robot's end-effector frame.
#   port show_cm: Whether or not to show the collision meshes (if any).
#   port show_acm: Whether or not to show the attached collision meshes (if any).
#   port visual: Rhino meshes of the robot's visual geometry (if any).
#   port collision: Rhino meshes of the robot's collision geometry (if any).
#   port collision_meshes: Rhino meshes of the scene's collision meshes (if any).
#   port attached_meshes: Rhino meshes of the scene's attached collision meshes (if any).
#   port frames: The robot's joint frames as Rhino planes (if any).
#   port base_frame: The robot's base frame as a Rhino plane (if any).
#   port ee_frame: The robot's end-effector frame as a Rhino plane (if any).
# ---------- robot_visualize: Python ----------
"""
Visualizes the robot.

COMPAS FAB v0.27.0
"""
from compas.artists import Artist
from compas.geometry import Frame
from compas.geometry import Transformation
from compas_fab.robots import PlanningScene
from ghpythonlib.componentbase import executingcomponent as component
import Rhino.Geometry as rg


class RobotVisualize(component):
    def RunScript(
        self,
        robot,
        group,
        configuration,
        show_visual,
        show_collision,
        show_frames,
        show_base_frame,
        show_end_effector_frame,
        show_cm,
        show_acm,
    ):

        visual = None
        collision = None
        collision_meshes = None
        attached_meshes = None
        frames = None
        base_frame = None
        ee_frame = None

        if robot:
            show_visual = True if show_visual is None else show_visual
            show_cm = True if show_cm is None else show_cm
            show_acm = True if show_acm is None else show_acm
            configuration = configuration or robot.zero_configuration()

            robot.update(configuration, visual=show_visual, collision=show_collision)
            compas_frames = robot.transformed_frames(configuration, group)

            if show_visual:
                visual = robot.artist.draw_visual()

            if show_collision:
                collision = robot.artist.draw_collision()

            if show_base_frame:
                base_compas_frame = compas_frames[0]
                artist = Artist(base_compas_frame)
                base_frame = artist.draw()

            if show_end_effector_frame:
                ee_compas_frame = robot.forward_kinematics(
                    configuration, group, options=dict(solver="model")
                )
                artist = Artist(ee_compas_frame)
                ee_frame = artist.draw()

            if show_frames:
                frames = []
                for compas_frame in compas_frames[1:]:
                    artist = Artist(compas_frame)
                    frame = artist.draw()
                    frames.append(frame)

            if show_cm or show_acm:
                scene = PlanningScene(robot)
                scene = robot.client.get_planning_scene()

                collision_meshes = []
                attached_meshes = []

                if show_cm:
                    for co in scene.world.collision_objects:
                        header = co.header
                        frame_id = header.frame_id
                        cms = co.to_collision_meshes()

                        for cm in cms:
                            if cm.frame != Frame.worldXY():
                                t = Transformation.from_frame(cm.frame)
                                mesh = cm.mesh.transformed(t)
                            else:
                                mesh = cm.mesh

                            collision_meshes.append(Artist(mesh).draw())

                if show_acm:
                    for aco in scene.robot_state.attached_collision_objects:
                        for acm in aco.to_attached_collision_meshes():
                            frame_id = aco.object["header"]["frame_id"]
                            frame = robot.forward_kinematics(
                                configuration, options=dict(link=frame_id)
                            )
                            t = Transformation.from_frame(frame)

                            # Local CM frame
                            if (
                                acm.collision_mesh.frame
                                and acm.collision_mesh.frame != Frame.worldXY()
                            ):
                                t = t * Transformation.from_frame(
                                    acm.collision_mesh.frame
                                )

                            mesh = acm.collision_mesh.mesh.transformed(t)

                            attached_meshes.append(Artist(mesh).draw())
#        for v in visual:
#            v.Transform(rg.Transform.Scale(rg.Point3d(0,0,0),10))
        return (
            visual,
            collision,
            collision_meshes,
            attached_meshes,
            frames,
            base_frame,
            ee_frame,
        )
# ---------- end robot_visualize ----------
range_4 = Range(Domain=dom_3, Steps=panel_27)  # disabled
item_10 = ListItem(List=orient_9.Geometry, Index=range_4, Wrap=True)  # disabled
scale = Scale(Geometry=robot_visualize.visual, Center=Point(0, 0, 0), Factor=1000)  # -> Geometry, Transform; disabled
geo_23 = Geometry(scale.Geometry)  # disabled

Y_2 = UnitY(Factor=1)  # disabled
panel_28 = Panel("90")  # disabled
rot3d_6 = Rotate3D(Geometry=B, Angle=degrees(panel_28), Center=Point(0, 0, 0), Axis=Y_2)  # -> Geometry, Transform; disabled
panel_29 = Panel("10")  # disabled
panel_30 = Panel("15")  # disabled
panel_31 = Panel("32")  # disabled
box_2 = CenterBox(Base=rot3d_6.Geometry, X=expr("x/2", panel_31), Y=expr("x/2", panel_30), Z=expr("x/2", panel_29))  # disabled
debrep_2 = DeconstructBrep(Brep=box)  # -> Faces, Edges, Vertices; disabled
debrep_3 = DeconstructBrep(Brep=box_2)  # -> Faces, Edges, Vertices; disabled
panel_32 = Panel("1")  # disabled
panel_33 = Panel("1")  # disabled
item_11 = ListItem(List=debrep_2.Vertices, Index=panel_33, Wrap=True)  # disabled
item_12 = ListItem(List=debrep_3.Vertices, Index=panel_32, Wrap=True)  # disabled
vec2pt_4 = Vector2Pt(PointA=item_12, PointB=item_11, Unitize=False)  # -> Vector, Length; disabled
move_11 = Move(Geometry=rot3d_6.Geometry, Motion=vec2pt_4.Vector)  # -> Geometry, Transform; disabled
merge_6 = Merge(Data1=B, Data2=move_11.Geometry)  # disabled
Y_3 = UnitY(Factor=1)  # disabled
number_slider_15 = Slider(4, range=0..10)  # disabled
panel_34 = Panel("45")  # disabled
number_slider_16 = Slider(12, range=0..100)  # disabled
rot3d_7 = Rotate3D(Geometry=merge_6, Angle=degrees(panel_34), Center=Point(0, 0, 0), Axis=Y_3)  # -> simplify(Geometry), Transform; disabled
panel_35 = Panel("45.25")  # disabled
series_8 = Series(Start=0, Step=panel_35, Count=number_slider_15)  # disabled
renumber_2 = RenumberPaths(Data=rot3d_7.Geometry)  # disabled
panel_36 = Panel("14.14")  # disabled
X_2 = UnitX(Factor=series_8)  # disabled
series_9 = Series(Start=0, Step=panel_36, Count=number_slider_16)  # -> graft(Series); disabled
move_12 = Move(Geometry=renumber_2, Motion=X_2)  # -> Geometry, Transform; disabled
Z_8 = UnitZ(Factor=series_9)  # disabled
flip = FlipMatrix(Data=move_12.Geometry)  # -> reverse(simplify(Data)); disabled
panel_37 = Panel("1")  # disabled
item_13 = ListItem(List=flip, Index=panel_37, Wrap=True)  # disabled
item_14 = ListItem(List=flip, Index=0, Wrap=True)  # disabled
deplane_10 = DeconstructPlane(Plane=item_14)  # -> Origin, XAxis, YAxis, ZAxis; disabled
neg_5 = Negative(Value=deplane_10.XAxis)  # disabled
pl_4 = ConstructPlane(Origin=deplane_10.Origin, XAxis=neg_5, YAxis=deplane_10.YAxis)  # disabled
merge_7 = Merge(Data1=pl_4, Data2=item_13)  # disabled
flatten_4 = FlattenTree(Tree=merge_7, Path="{0}")  # disabled
move_13 = Move(Geometry=flatten_4, Motion=Z_8)  # -> flatten(Geometry), Transform; disabled
deplane_11 = DeconstructPlane(Plane=move_13.Geometry)  # -> Origin, XAxis, YAxis, ZAxis; disabled
plnaxis_2 = PlaneAxis(P=move_13.Geometry, B=35)  # disabled
number_slider_17 = Slider(0.52, range=0..1)  # disabled
number_slider_18 = Slider(0.6, range=0..1)  # disabled
perlin = PerlinNoise(Values=deplane_11.Origin, Time=number_slider_17, Scale=number_slider_18)  # disabled
panel_38 = Panel("7")  # disabled
bnd_2 = Bounds(Numbers=perlin)  # disabled
dom_4 = ConstructDomain(DomainStart=0, DomainEnd=panel_38)  # disabled
remap_2 = RemapNumbers(Value=perlin, Source=bnd_2, Target=dom_4)  # -> Mapped, Clipped; disabled
Y_4 = UnitY(Factor=remap_2.Mapped)  # disabled
number_slider_19 = Slider(9, range=0..100)  # disabled
number_slider_20 = Slider(240, range=1..240)  # disabled
move_14 = Move(Geometry=move_13.Geometry, Motion=Y_4)  # -> Geometry, Transform; disabled
points_2 = PointList(Points=move_13.Geometry, Size=number_slider_19)  # disabled
series_10 = Series(Start=0, Step=1, Count=number_slider_20)  # disabled
swatch_2 = ColourSwatch(SwatchColor=RGB(107, 107, 107))  # disabled

panel_39 = Panel("32")  # disabled
panel_40 = Panel("15")  # disabled
panel_41 = Panel("10")  # disabled
box_3 = CenterBox(Base=move_14.Geometry, X=expr("x/2", panel_39), Y=expr("x/2", panel_40), Z=expr("x/2", panel_41))  # disabled

lng_3 = ListLength(List=box_3)  # disabled
item_15 = ListItem(List=box_3, Index=series_10, Wrap=True)  # disabled
first_last = FirstLast(List=item_15)  # -> FirstValue, LastValue; disabled
preview_5 = CustomPreview(Geometry=box_3, Material=swatch_2)  # disabled

# ==== cluster PlaneAxis: show plane X Y Z axis.
P = ClusterInput()
B = ClusterInput()
deplane = DeconstructPlane(Plane=graft(P))  # -> Origin, XAxis, YAxis, ZAxis
multiplication = Multiplication(A=[deplane.XAxis, deplane.YAxis, deplane.ZAxis], B=B)
vdisex = VectorDisplayEx(
    Point=deplane.Origin,
    Vector=multiplication,
    Colour=[ColourSwatch(SwatchColor=RGB(235, 52, 52)), ColourSwatch(SwatchColor=RGB(90, 207, 48)), ColourSwatch(SwatchColor=RGB(54, 126, 227))],
    Width=2)
