# Grasshopper definition demo_v2.ghx (Grasshopper 1.0.7)
# plug-ins: treesloth01

# ----
# Make a Brick
panel = Panel("32")
B = Base(PlaneXY(0, 0, 0))
division = Division(A="10", B="2")
box = CenterBox(Base=B, X=expr("x/2", panel), Y=expr("x/2", "15"), Z=expr("x/2", "10"))
Z = UnitZ(Factor=division)
move = Move(Geometry=box, Motion=Z)  # -> Geometry, Transform

number_slider = Slider(12, range=0..100)  # disabled

# ----
# Send planes layer by layer
number_slider_2 = Slider(11, range=0..11)

number_slider_3 = Slider(240, range=1..240)  # disabled

Y = UnitY(Factor=1)  # disabled
panel_2 = Panel("90")  # disabled
rot3d = Rotate3D(Geometry=B, Angle=degrees(panel_2), Center=Point(0, 0, 0), Axis=Y)  # -> Geometry, Transform; disabled
panel_3 = Panel("32")  # disabled
panel_4 = Panel("15")  # disabled
panel_5 = Panel("10")  # disabled
box_2 = CenterBox(Base=rot3d.Geometry, X=expr("x/2", panel_3), Y=expr("x/2", panel_4), Z=expr("x/2", panel_5))  # disabled
debrep = DeconstructBrep(Brep=box)  # -> Faces, Edges, Vertices; disabled
debrep_2 = DeconstructBrep(Brep=box_2)  # -> Faces, Edges, Vertices; disabled
panel_6 = Panel("1")  # disabled
panel_7 = Panel("1")  # disabled
item = ListItem(List=debrep.Vertices, Index=panel_6, Wrap=True)  # disabled
item_2 = ListItem(List=debrep_2.Vertices, Index=panel_7, Wrap=True)  # disabled
vec2pt = Vector2Pt(PointA=item_2, PointB=item, Unitize=False)  # -> Vector, Length; disabled
move_2 = Move(Geometry=rot3d.Geometry, Motion=vec2pt.Vector)  # -> Geometry, Transform; disabled
merge = Merge(Data1=B, Data2=move_2.Geometry)  # disabled
Y_2 = UnitY(Factor=1)  # disabled
panel_8 = Panel("45")  # disabled
rot3d_2 = Rotate3D(Geometry=merge, Angle=degrees(panel_8), Center=Point(0, 0, 0), Axis=Y_2)  # -> simplify(Geometry), Transform; disabled
panel_9 = Panel("45.25")  # disabled
series = Series(Start=0, Step=panel_9, Count=10)  # disabled
renumber = RenumberPaths(Data=rot3d_2.Geometry)  # disabled
panel_10 = Panel("14.14")  # disabled
X = UnitX(Factor=series)  # disabled
series_2 = Series(Start=0, Step=panel_10, Count=number_slider)  # -> graft(Series); disabled
move_3 = Move(Geometry=renumber, Motion=X)  # -> Geometry, Transform; disabled
Z_2 = UnitZ(Factor=series_2)  # disabled
flip = FlipMatrix(Data=move_3.Geometry)  # -> reverse(simplify(Data)); disabled
panel_11 = Panel("1")  # disabled
item_3 = ListItem(List=flip, Index=panel_11, Wrap=True)  # disabled
item_4 = ListItem(List=flip, Index=0, Wrap=True)  # disabled
deplane = DeconstructPlane(Plane=item_4)  # -> Origin, XAxis, YAxis, ZAxis; disabled
neg = Negative(Value=deplane.XAxis)  # disabled
pl = ConstructPlane(Origin=deplane.Origin, XAxis=neg, YAxis=deplane.YAxis)  # disabled
merge_2 = Merge(Data1=pl, Data2=item_3)  # disabled
flatten = FlattenTree(Tree=merge_2, Path="{0}")  # disabled
move_4 = Move(Geometry=flatten, Motion=Z_2)  # -> flatten(Geometry), Transform; disabled
number_slider_4 = Slider(9, range=0..100)  # disabled
panel_12 = Panel("32")  # disabled
panel_13 = Panel("15")  # disabled
panel_14 = Panel("10")  # disabled
plnaxis = PlaneAxis(P=move_4.Geometry, B=35)  # disabled
points = PointList(Points=move_4.Geometry, Size=number_slider_4)  # disabled
box_3 = CenterBox(Base=move_4.Geometry, X=expr("x/2", panel_12), Y=expr("x/2", panel_13), Z=expr("x/2", panel_14))  # disabled
series_3 = Series(Start=0, Step=1, Count=number_slider_3)  # disabled
item_5 = ListItem(List=box_3, Index=series_3, Wrap=True)  # disabled

lng = ListLength(List=box_3)  # disabled
first_last = FirstLast(List=item_5)  # -> FirstValue, LastValue; disabled
panel_15 = Panel(lng)  # disabled
swatch = ColourSwatch(SwatchColor=RGB(255, 255, 255))  # disabled
preview = CustomPreview(Geometry=first_last.LastValue, Material=swatch)  # disabled

# ---- group: backup
geometry = Geometry([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])
geometry_2 = Geometry([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])
geometry_3 = Geometry([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])
geometry_4 = Geometry([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])
geometry_5 = Geometry([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])
geometry_6 = Geometry([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])
geometry_7 = Geometry([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])
geometry_8 = Geometry([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])
geometry_9 = Geometry([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])
geometry_10 = Geometry([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])
geometry_11 = Geometry([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])
merge_3 = Merge(
    Data1=geometry,
    Data2=geometry_2,
    Data3=geometry_3,
    Data4=geometry_4,
    Data5=geometry_5,
    Data6=geometry_6,
    Data7=geometry_7,
    Data8=geometry_8,
    Data9=geometry_9,
    Data10=geometry_10,
    Data11=geometry_11)  # -> flatten(Result)

# ----
ghpython_script = GhPythonScript(file_name="simulation.py")  # -> path
# ---------- ghpython_script: Python ----------
a = ghdoc.Path
b = ghdoc.Name

path = (a[::-1].replace('xhg.'+b[::-1].replace('*','',1),'',1))[::-1]+file_name
# ---------- end ghpython_script ----------
read_file = ReadFile(File=ghpython_script, PerLineParse=False)

geometry_12 = Geometry([Plane(origin=(130.5129571, 928.2940481, 95.29507717), x=(0.8660254069, 0, 0.4999999947), y=(-0.2499999971, 0.866025404, 0.4330127031)), Plane(origin=(112.6329571, 928.2940481, 95.29507717), x=(0.8660254069, 0, 0.4999999947), y=(-0.2499999971, 0.866025404, 0.4330127031)), Plane(origin=(94.75295712, 928.2940481, 95.29507717), x=(0.8660254069, 0, 0.4999999947), y=(-0.2499999971, 0.866025404, 0.4330127031)), Plane(origin=(76.87295712, 928.2940481, 95.29507717), x=(0.8660254069, 0, 0.4999999947), y=(-0.2499999971, 0.866025404, 0.4330127031)), Plane(origin=(138.512957, 900.5812352, 81.43867067), x=(0.8660254069, 0, 0.4999999947), y=(-0.2499999971, 0.866025404, 0.4330127031)), Plane(origin=(120.632957, 900.5812352, 81.43867067), x=(0.8660254069, 0, 0.4999999947), y=(-0.2499999971, 0.866025404, 0.4330127031))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])
pt = ConstructPoint(XCoordinate="0", YCoordinate="0", ZCoordinate="0")
dom = ConstructDomain(DomainStart="305", DomainEnd="334")
partition = PartitionList(List=geometry_12, Size=[30, 30])  # -> simplify(Chunks)

# ---- group: backup
custom_preview = CustomPreview(Geometry=merge_3, Material=ColourSwatch(SwatchColor=RGBA(232, 0, 0, 249)))

# ----
construct_plane = ConstructPlane(Origin=pt, XAxis=Vector(1, 0, 0), YAxis=Vector(0, 1, 0))
range = Range(Domain=dom, Steps="29")
branch = TreeBranch(Tree=partition, Path=number_slider_2, MaintainPaths=True)
series_4 = Series(Start=0, Step=1, Count=10)
item_6 = ListItem(List=geometry_12, Index=range, Wrap=True)

toggle_freedrive = GhPythonScript(ip="192.168.10.10", start_teach_mode=Toggle(False), stop_teach_mode=Toggle(False))  # -> a
# ---------- toggle_freedrive: Python ----------
import os
import math

from compas.rpc import Proxy

if start_teach_mode:   
    canvas = ghenv.Component.OnPingDocument()
    path = os.path.abspath(os.path.dirname(canvas.FilePath))
    rtde = Proxy('fabrication', path=path)                         # stay in teach moded(freedrive) as long as this is True
    a = rtde.start_teach_mode(ip=ip)            # send message to robot
    ghenv.Component.Message = "Freedrive on"    # display message on GH component

if stop_teach_mode:   
    canvas = ghenv.Component.OnPingDocument()
    path = os.path.abspath(os.path.dirname(canvas.FilePath))
    rtde = Proxy('fabrication', path=path)                          # stop teach mode if stop button pressed
    a = rtde.stop_teach_mode(ip=ip)             # send message to robot   
    ghenv.Component.Message = "Freedrive off"   # display message on GH component
# ---------- end toggle_freedrive ----------

fib = Fibonacci(SeedA=series_4, SeedB=1, Number=10)
list_item = ListItem(List=merge_3, Index=0, Wrap=True)
list_item_2 = ListItem(List=merge_3, Index=0, Wrap=True)
panel_16 = Panel(fib)
deconstruct_brep = DeconstructBrep(Brep=list_item_2)  # -> Faces, Edges, Vertices
list_item_3 = ListItem(List=deconstruct_brep.Faces, Index=Slider(5, range=0..10), Wrap=True)

# ---- group: Table
geometry_13 = Geometry(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)

# ---- group: Robot Base
geometry_14 = Geometry(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)

# ---- group: Pickup Station
geometry_15 = Geometry(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)

# ----
list_item_4 = ListItem(List=deconstruct_brep.Vertices, Index=0, Wrap=True)  # -> Item, Item1, Item2, Item3, Item4, Item5, Item6, Item7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
geometry_16 = Geometry(list_item_4.Item4)
deconstruct_plane = DeconstructPlane(Plane=list_item_3)  # -> Origin, XAxis, YAxis, ZAxis
ghpython_script_2 = GhPythonScript(file_name="robot_listen.py")  # -> path; same code as ghpython_script
vector_2pt = Vector2Pt(PointA=deconstruct_plane.Origin, PointB=list_item_4.Item4, Unitize=False)  # -> Vector, Length
vector_2pt_2 = Vector2Pt(PointA=deconstruct_plane.Origin, PointB=list_item_4.Item6, Unitize=False)  # -> Vector, Length
read_file_2 = ReadFile(File=ghpython_script_2, PerLineParse=False)
multiplication = Multiplication(A=vector_2pt.Vector, B=0.5)
multiplication_2 = Multiplication(A=vector_2pt_2.Vector, B=0.5)
ghpython_script_3 = GhPythonScript(button=Toggle(True), ROBOT_IP="192.168.10.10")  # -> out, a
# ---------- ghpython_script_3: Python ----------
from imp import reload
import Rhino.Geometry as rg
import simple_ur_script as ur
reload(ur)
import simple_comm as c
reload(c)
import math as m
from compas.geometry import Frame
from compas_rhino.conversions import frame_to_rhino

def tcp(script):
    # script += ur.set_tcp_by_angles(-0.35, 0.5, 89.08, m.radians(0.0), m.radians(3.1415),m.radians(0.0))
    # script += ur.set_tcp_by_angles(-0.35, 0.5, 89.08, m.radians(0.0), m.radians(0),m.radians(0.0))
    script += ur.set_tcp_by_angles(-0.35, 0.5, 89.08, 0.0, 3.1415, 1.57)
    
    return script
def send(script):
    script = c.concatenate_script(script)
    c.send_script(script, ROBOT_IP)
    return script 
    
    
    
script = ''
if button:
    script = tcp(script)
    send (script)
# ---------- end ghpython_script_3 ----------
addition = Addition(A=multiplication_2, B=multiplication)
move_5 = Move(Geometry=deconstruct_plane.Origin, Motion=addition)  # -> Geometry, Transform
construct_plane_2 = ConstructPlane(Origin=move_5.Geometry, XAxis=deconstruct_plane.YAxis, YAxis=expr("-x", deconstruct_plane.XAxis))
geometry_17 = Geometry()
geometry_18 = Geometry(Plane(origin=(130.5129571, 928.2940481, 95.29507717), x=(0.8986609222, -0.1455916388, 0.4137772608), y=(-0.03696385885, 0.9148193651, 0.4021681271)))
orient = Orient(Geometry=merge_3, Source=construct_plane_2, Target=geometry_18)  # -> Geometry, Transform
boolean_toggle = BooleanToggle(True)
ur10e = GhPythonScript()  # -> robot
# ---------- ur10e: Python ----------
import os

import compas_fab
from compas.artists import Artist
from compas.geometry import Frame
from compas.robots import RobotModel
from compas.robots.resources import LocalPackageMeshLoader
from compas_fab.backends import AnalyticalInverseKinematics
from compas_fab.backends import OffsetWristKinematics
from compas_fab.backends.interfaces import ClientInterface
from compas_fab.robots import Robot
from compas_fab.robots import RobotSemantics


canvas = ghenv.Component.OnPingDocument()
#
urdf_folder = os.path.join(os.path.dirname(canvas.FilePath), '../dependencies/robots')
#urdf_file = os.path.join(urdf_folder, 'ur10e.urdf')

srdf_file = os.path.join(urdf_folder, 'ur10e.srdf')
#model = RobotModel.from_urdf_file(urdf_file)
#model = RobotModel.from_urdf_file('C:\Zac\GitHub\endless-wall-teamwork\dependencies\ur10.urdf')
urdf_file = compas_fab.get('universal_robot/ur_description/urdf/ur5.urdf')
model = RobotModel.from_urdf_file(urdf_file)

loader = LocalPackageMeshLoader(compas_fab.get('universal_robot'), 'ur_description')
model.load_geometry(loader)

semantics = RobotSemantics.from_srdf_file(srdf_file, model)

client = ClientInterface()
client.is_connected = True
client.inverse_kinematics = AnalyticalInverseKinematics(solver='ur10e')

robot = Robot(model, client=client, semantics=semantics)
robot.artist = Artist(model)
# ---------- end ur10e ----------
deconstruct_plane_2 = DeconstructPlane(Plane=construct_plane_2)  # -> Origin, XAxis, YAxis, ZAxis
deconstruct_plane_3 = DeconstructPlane(Plane=geometry_18)  # -> Origin, XAxis, YAxis, ZAxis
vector_2pt_3 = Vector2Pt(PointA=deconstruct_plane_2.Origin, PointB=deconstruct_plane_3.Origin, Unitize=False)  # -> Vector, Length
move_6 = Move(Geometry=construct_plane_2, Motion=vector_2pt_3.Vector)  # -> Geometry, Transform
geometry_19 = Geometry(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)
geometry_20 = Geometry([Plane(origin=(4326.842561, 496.4232481, 95.07750284), x=(0.8660254069, 0, 0.4999999947), y=(-0.2499999971, 0.866025404, 0.4330127031)), Plane(origin=(4308.962561, 496.4232481, 95.07750284), x=(0.8660254069, 0, 0.4999999947), y=(-0.2499999971, 0.866025404, 0.4330127031)), Plane(origin=(4291.082561, 496.4232481, 95.07750284), x=(0.8660254069, 0, 0.4999999947), y=(-0.2499999971, 0.866025404, 0.4330127031)), Plane(origin=(4273.202561, 496.4232481, 95.07750284), x=(0.8660254069, 0, 0.4999999947), y=(-0.2499999971, 0.866025404, 0.4330127031)), Plane(origin=(4334.842561, 468.7104352, 81.22109634), x=(0.8660254069, 0, 0.4999999947), y=(-0.2499999971, 0.866025404, 0.4330127031)), Plane(origin=(4316.962561, 468.7104352, 81.22109634), x=(0.8660254069, 0, 0.4999999947), y=(-0.2499999971, 0.866025404, 0.4330127031))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])
orient_2 = Orient(Geometry=geometry_19, Source=construct_plane_2, Target=move_6.Geometry)  # -> Geometry, Transform
orient_3 = Orient(Geometry=geometry_20, Source=construct_plane_2, Target=move_6.Geometry)  # -> Geometry, Transform
orient_4 = Orient(Geometry=merge_3, Source=construct_plane_2, Target=move_6.Geometry)  # -> simplify(Geometry), Transform
partition_2 = PartitionList(List=orient_4.Geometry, Size=[30, 30])  # -> simplify(Chunks)
series_5 = Series(Start="3", Step=1, Count=Slider(9, range=0..10))
preview_2 = CustomPreview(
    Geometry=orient_2.Geometry,
    Material={diffuse=RGB(221, 160, 221), emission=RGB(66, 48, 66), shine=0.5, specular=RGB(255, 255, 255), transparency=0})
branch_2 = TreeBranch(Tree=partition_2, Path=series_5, MaintainPaths=True)
panel_17 = Panel(series_5)
dom_2 = ConstructDomain(DomainStart="305", DomainEnd="334")
range_2 = Range(Domain=dom_2, Steps="29")
item_7 = ListItem(List=orient_4.Geometry, Index=range_2, Wrap=True)
panel_18 = Panel(orient_4.Geometry)

# ----
# Brick Wall_Version 1
number_slider_5 = Slider(173, range=0..1000)
cir = Circle(Plane=PlaneXY(0, 0, 0), Radius=number_slider_5)
series_6 = Series(Start=0, Step="10", Count=Slider(12, range=0..100))
multiplication_3 = Multiplication(A=number_slider_5, B=Slider(2, range=0..10))
Z_3 = UnitZ(Factor=series_6)
panel_19 = Panel(multiplication_3)
move_7 = Move(Geometry=cir, Motion=Z_3)  # -> simplify(Geometry), Transform
dom_3 = ConstructDomain(DomainStart=0, DomainEnd=Slider(45, range=0..180))
number_slider_6 = Slider(60, range=0..100)
range_3 = Range(Domain=dom_3, Steps=expr("x-1", "30"))
dispatch = Dispatch(List=move_7.Geometry, DispatchPattern=[True, False])  # -> ListA, ListB
graph = GraphMapper(range_3, x0=0, x1=45, y0=0, y1=45, container_name="Sine", Equation_px=[0, 0.5064998269], Equation_py=[0, 1])
division_2 = Division(A=number_slider_6, B="2")
hframes = HorizontalFrames(Curve=dispatch.ListA, Count=number_slider_6)  # -> Frames, Parameters
hframes_2 = HorizontalFrames(Curve=dispatch.ListB, Count=number_slider_6)  # -> Frames, Parameters
panel_20 = Panel(division_2)
dispatch_2 = Dispatch(List=hframes.Frames, DispatchPattern=[True, False])  # -> ListA, ListB
dispatch_3 = Dispatch(List=hframes_2.Frames, DispatchPattern=[True, False])  # -> ListA, ListB
pln = Plane(simplify(dispatch_2.ListA))
pln_2 = Plane(simplify(dispatch_3.ListB))
prot = RotatePlane(Plane=pln_2, Angle=degrees(graph))  # -> simplify(Plane)
neg_2 = Negative(Value=graph)
prot_2 = RotatePlane(Plane=pln, Angle=degrees(neg_2))  # -> simplify(Plane)
path_mapper = PathMapper(prot, source="(A)", target="(A;+1)")
merge_4 = Merge(Data1=prot_2, Data2=path_mapper)  # -> simplify(Result)
series_7 = Series(Start=0, Step="12", Count="12")  # -> graft(Series)
pt_2 = ConstructPoint(XCoordinate=0, YCoordinate=0, ZCoordinate=0)
rotate = Rotate(Geometry=merge_4, Angle=degrees(series_7), Plane=pt_2)  # -> Geometry, Transform
renumber_2 = RenumberPaths(Data=rotate.Geometry)
Z_4 = UnitZ(Factor="10")
move_8 = Move(Geometry=renumber_2, Motion=Z_4)  # -> Geometry, Transform
tstat = TreeStatistics(Tree=move_8.Geometry)  # -> Paths, Length, Count
flatten_2 = FlattenTree(Tree=move_8.Geometry, Path="{0}")
lng_2 = ListLength(List=flatten_2)
branch_3 = TreeBranch(Tree=move_8.Geometry, Path=number_slider_2, MaintainPaths=True)
series_8 = Series(Start=0, Step=1, Count=lng_2)
gradient = Gradient(
    LowerLimit=0,
    UpperLimit=lng_2,
    Parameter=series_8,
    stops=[0: RGB(234, 38, 0), 0.25: RGB(234, 126, 0), 0.5: RGB(254, 244, 84), 0.75: RGB(173, 203, 249), 1: RGB(75, 107, 169)])
X_2 = UnitX(Factor=Slider(186, range=0..1000))
Z_5 = UnitZ(Factor="9")
Y_3 = UnitY(Factor=Slider(186, range=0..1000))
geo = Geometry(flatten(branch_3))
addition_2 = Addition(B=X_2, C=Y_3)
pln_3 = Plane(geo)
move_9 = Move(Geometry=pln_3, Motion=addition_2)  # -> Geometry, Transform
preview_3 = CustomPreview(Geometry=flatten_2, Material=gradient)

orient_5 = Orient(Geometry=move.Geometry, Source=B, Target=flatten_2)  # -> Geometry, Transform

# ----
# Export Plane
rotate_2 = Rotate(Geometry=move_9.Geometry, Angle=0, Plane=move_9.Geometry)  # -> Geometry, Transform

rotate_3 = Rotate(Geometry=move_9.Geometry, Angle=degrees("-90"), Plane=move_9.Geometry)  # -> Geometry, Transform

points_2 = PointList(Points=rotate_3.Geometry, Size=Slider(23, range=0..100))

# ----
# Brick Visualization
orient_6 = Orient(Geometry=move.Geometry, Source=B, Target=rotate_2.Geometry)  # -> Geometry, Transform

plnaxis_2 = PlaneAxis(P=rotate_3.Geometry, B=35)
colmm = CollisionManyMany(Colliders=orient_6.Geometry)  # -> Collision, Indices

# ---- group: FABRICATION WORKFLOW
python = GhPythonScript(
    Code=read_file,
    ROBOT_IP="192.168.10.10",
    Picking_planes=item_6,
    Brick_planes=rotate_3.Geometry,
    Fabricate=Button(),
    Debug_plane=construct_plane)  # -> Out, Robot_base_plane, Script, Debug_plane

# ----
panel_21 = Panel(python.Out)

# ---- group: Get robot pose
ghpython_script_4 = GhPythonScript(Code=read_file_2, Listen=Toggle(True), Robot_base_plane=python.Robot_base_plane)  # -> Out, Pose, Config

# ----
radians = Radians(Degrees=ghpython_script_4.Config)
panel_22 = Panel(ghpython_script_4.Out)
list_item_5 = ListItem(List=radians, Index=0, Wrap=True)  # -> Item, Item1, Item2, Item3, Item4, Item5
ghpython_script_5 = GhPythonScript(
    x=list_item_5.Item,
    y=list_item_5.Item1,
    z=list_item_5.Item2,
    u=list_item_5.Item3,
    v=list_item_5.Item4,
    w=list_item_5.Item5)  # -> configuration
# ---------- ghpython_script_5: Python ----------
import rhinoscriptsyntax as rs

from compas.robots import configuration
from compas_fab.robots import Configuration

configuration = Configuration.from_revolute_values([x,y,z,u,v,w])
# ---------- end ghpython_script_5 ----------
robot_visualize = COMPASFABRobotVisualize(
    robot=ur10e,
    configuration=ghpython_script_5,
    show_collision=boolean_toggle,
    show_frames=boolean_toggle,
    show_cm=Toggle(False),
    show_acm=Toggle(False))  # -> visual, collision, collision_meshes, attached_meshes, frames, base_frame, ee_frame; inputs show_visual: Boolean, show_collision: Boolean, show_frames: Boolean, show_base_frame: Boolean, show_end_effector_frame: Boolean, show_cm: Boolean, show_acm: Boolean
#   port group: The planning group used for end-effector and base visualization.
#   port configuration: The robot's full configuration.
#   port show_visual: Whether or not to show the robot's visual meshes.
#   port show_collision: Whether or not to show the robot's collision meshes.
#   port show_frames: Whether or not to show the robot's joint frames.
#   port show_base_frame: Whether or not to show the robot's base frame.
#   port show_end_effector_frame: Whether or not to show the robot's end-effector frame.
#   port show_cm: Whether or not to show the collision meshes (if any).
#   port show_acm: Whether or not to show the attached collision meshes (if any).
#   port visual: Rhino meshes of the robot's visual geometry (if any).
#   port collision: Rhino meshes of the robot's collision geometry (if any).
#   port collision_meshes: Rhino meshes of the scene's collision meshes (if any).
#   port attached_meshes: Rhino meshes of the scene's attached collision meshes (if any).
#   port frames: The robot's joint frames as Rhino planes (if any).
#   port base_frame: The robot's base frame as a Rhino plane (if any).
#   port ee_frame: The robot's end-effector frame as a Rhino plane (if any).
# ---------- robot_visualize: Python ----------
"""
Visualizes the robot.

COMPAS FAB v0.27.0
"""
from compas.artists import Artist
from compas.geometry import Frame
from compas.geometry import Transformation
from compas_fab.robots import PlanningScene
from ghpythonlib.componentbase import executingcomponent as component
import Rhino.Geometry as rg


class RobotVisualize(component):
    def RunScript(
        self,
        robot,
        group,
        configuration,
        show_visual,
        show_collision,
        show_frames,
        show_base_frame,
        show_end_effector_frame,
        show_cm,
        show_acm,
    ):

        visual = None
        collision = None
        collision_meshes = None
        attached_meshes = None
        frames = None
        base_frame = None
        ee_frame = None

        if robot:
            show_visual = True if show_visual is None else show_visual
            show_cm = True if show_cm is None else show_cm
            show_acm = True if show_acm is None else show_acm
            configuration = configuration or robot.zero_configuration()

            robot.update(configuration, visual=show_visual, collision=show_collision)
            compas_frames = robot.transformed_frames(configuration, group)

            if show_visual:
                visual = robot.artist.draw_visual()

            if show_collision:
                collision = robot.artist.draw_collision()

            if show_base_frame:
                base_compas_frame = compas_frames[0]
                artist = Artist(base_compas_frame)
                base_frame = artist.draw()

            if show_end_effector_frame:
                ee_compas_frame = robot.forward_kinematics(
                    configuration, group, options=dict(solver="model")
                )
                artist = Artist(ee_compas_frame)
                ee_frame = artist.draw()

            if show_frames:
                frames = []
                for compas_frame in compas_frames[1:]:
                    artist = Artist(compas_frame)
                    frame = artist.draw()
                    frames.append(frame)

            if show_cm or show_acm:
                scene = PlanningScene(robot)
                scene = robot.client.get_planning_scene()

                collision_meshes = []
                attached_meshes = []

                if show_cm:
                    for co in scene.world.collision_objects:
                        header = co.header
                        frame_id = header.frame_id
                        cms = co.to_collision_meshes()

                        for cm in cms:
                            if cm.frame != Frame.worldXY():
                                t = Transformation.from_frame(cm.frame)
                                mesh = cm.mesh.transformed(t)
                            else:
                                mesh = cm.mesh

                            collision_meshes.append(Artist(mesh).draw())

                if show_acm:
                    for aco in scene.robot_state.attached_collision_objects:
                        for acm in aco.to_attached_collision_meshes():
                            frame_id = aco.object["header"]["frame_id"]
                            frame = robot.forward_kinematics(
                                configuration, options=dict(link=frame_id)
                            )
                            t = Transformation.from_frame(frame)

                            # Local CM frame
                            if (
                                acm.collision_mesh.frame
                                and acm.collision_mesh.frame != Frame.worldXY()
                            ):
                                t = t * Transformation.from_frame(
                                    acm.collision_mesh.frame
                                )

                            mesh = acm.collision_mesh.mesh.transformed(t)

                            attached_meshes.append(Artist(mesh).draw())
#        for v in visual:
#            v.Transform(rg.Transform.Scale(rg.Point3d(0,0,0),10))
        return (
            visual,
            collision,
            collision_meshes,
            attached_meshes,
            frames,
            base_frame,
            ee_frame,
        )
# ---------- end robot_visualize ----------
scale = Scale(Geometry=robot_visualize.visual, Center=Point(0, 0, 0), Factor=1000)  # -> Geometry, Transform
geometry_21 = Geometry(scale.Geometry)

# ==== cluster PlaneAxis: show plane X Y Z axis.
P = ClusterInput()
B = ClusterInput()
deplane = DeconstructPlane(Plane=graft(P))  # -> Origin, XAxis, YAxis, ZAxis
multiplication = Multiplication(A=[deplane.XAxis, deplane.YAxis, deplane.ZAxis], B=B)
vdisex = VectorDisplayEx(
    Point=deplane.Origin,
    Vector=multiplication,
    Colour=[ColourSwatch(SwatchColor=RGB(235, 52, 52)), ColourSwatch(SwatchColor=RGB(90, 207, 48)), ColourSwatch(SwatchColor=RGB(54, 126, 227))],
    Width=2)
