# Grasshopper definition simulation.gh (Grasshopper 1.0.7)

panel = Panel("C:\Zac\GitHub\endless-wall-teamwork\simulation\fabrication_workflow.py")
geometry = Geometry(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)
geometry_2 = Geometry(<mesh referenced from the Rhino model>)
read_file = ReadFile(File=panel, PerLineParse=False)
# Toggle freedrive to move robot
panel_2 = Panel("192.168.10.10")

# ---- group: FABRICATION WORKFLOW
python = GhPythonScript(Code=read_file, ROBOT_IP=panel_2, Fabricate=Button())  # -> Out, Script, Vis_planes, Pick_up_plane, Pick_station
pln = Plane(python.Vis_planes)
panel_3 = Panel(python.Out)

# ----
toggle_freedrive = GhPythonScript(ip=panel_2, start_teach_mode=Toggle(False), stop_teach_mode=Toggle(True))  # -> a
# ---------- toggle_freedrive: Python ----------
import os
import math

from compas.rpc import Proxy

if start_teach_mode:   
    canvas = ghenv.Component.OnPingDocument()
    path = os.path.abspath(os.path.dirname(canvas.FilePath))
    rtde = Proxy('fabrication', path=path)                         # stay in teach moded(freedrive) as long as this is True
    a = rtde.start_teach_mode(ip=ip)            # send message to robot
    ghenv.Component.Message = "Freedrive on"    # display message on GH component

if stop_teach_mode:   
    canvas = ghenv.Component.OnPingDocument()
    path = os.path.abspath(os.path.dirname(canvas.FilePath))
    rtde = Proxy('fabrication', path=path)                          # stop teach mode if stop button pressed
    a = rtde.stop_teach_mode(ip=ip)             # send message to robot   
    ghenv.Component.Message = "Freedrive off"   # display message on GH component
# ---------- end toggle_freedrive ----------

# ---- group: backup
geometry_3 = Geometry([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])  # disabled
geometry_4 = Geometry([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])  # disabled
geometry_5 = Geometry([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])  # disabled
geometry_6 = Geometry([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])  # disabled
geometry_7 = Geometry([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])  # disabled
geometry_8 = Geometry([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])  # disabled
geometry_9 = Geometry([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])  # disabled
geometry_10 = Geometry([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])  # disabled
geometry_11 = Geometry([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])  # disabled
geometry_12 = Geometry([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])  # disabled
geometry_13 = Geometry([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])  # disabled
merge = Merge(
    Data1=geometry_3,
    Data2=geometry_4,
    Data3=geometry_5,
    Data4=geometry_6,
    Data5=geometry_7,
    Data6=geometry_8,
    Data7=geometry_9,
    Data8=geometry_10,
    Data9=geometry_11,
    Data10=geometry_12,
    Data11=geometry_13)  # -> flatten(Result); disabled

colour_swatch = ColourSwatch(SwatchColor=RGBA(232, 0, 0, 249))  # disabled
custom_preview = CustomPreview(Geometry=merge, Material=colour_swatch)  # disabled

# ----
pln_2 = Plane(python.Pick_up_plane)
pln_3 = Plane(python.Pick_station)
panel_4 = Panel(pln_3)
