# Grasshopper definition simulation.ghx (Grasshopper 1.0.7)

number_slider = Slider(100, range=0..100)

ghpython_script = GhPythonScript(file_name="simulation.py")  # -> path
# ---------- ghpython_script: Python ----------
a = ghdoc.Path
b = ghdoc.Name

path = (a[::-1].replace('xhg.'+b[::-1].replace('*','',1),'',1))[::-1]+file_name
# ---------- end ghpython_script ----------
read_file = ReadFile(File=ghpython_script, PerLineParse=False)

pt = ConstructPoint(XCoordinate="0", YCoordinate="0", ZCoordinate="0")
construct_plane = ConstructPlane(Origin=pt, XAxis=Vector(1, 0, 0), YAxis=Vector(0, 1, 0))

# ---- group: FABRICATION WORKFLOW
python = GhPythonScript(Code=read_file, ROBOT_IP="192.168.10.10", Fabricate=Button(), Debug_plane=construct_plane)  # -> Out, Robot_base_plane, Script

# ----
toggle_freedrive = GhPythonScript(ip="192.168.10.10", start_teach_mode=Toggle(False), stop_teach_mode=Toggle(False))  # -> a
# ---------- toggle_freedrive: Python ----------
import os
import math

from compas.rpc import Proxy

if start_teach_mode:   
    canvas = ghenv.Component.OnPingDocument()
    path = os.path.abspath(os.path.dirname(canvas.FilePath))
    rtde = Proxy('fabrication', path=path)                         # stay in teach moded(freedrive) as long as this is True
    a = rtde.start_teach_mode(ip=ip)            # send message to robot
    ghenv.Component.Message = "Freedrive on"    # display message on GH component

if stop_teach_mode:   
    canvas = ghenv.Component.OnPingDocument()
    path = os.path.abspath(os.path.dirname(canvas.FilePath))
    rtde = Proxy('fabrication', path=path)                          # stop teach mode if stop button pressed
    a = rtde.stop_teach_mode(ip=ip)             # send message to robot   
    ghenv.Component.Message = "Freedrive off"   # display message on GH component
# ---------- end toggle_freedrive ----------

# ---- group: backup
geometry = Geometry([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])
geometry_2 = Geometry([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])
geometry_3 = Geometry([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])
geometry_4 = Geometry([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])
geometry_5 = Geometry([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])
geometry_6 = Geometry([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])
geometry_7 = Geometry([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])
geometry_8 = Geometry([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])
geometry_9 = Geometry([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])
geometry_10 = Geometry([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])
geometry_11 = Geometry([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])
merge = Merge(
    Data1=geometry,
    Data2=geometry_2,
    Data3=geometry_3,
    Data4=geometry_4,
    Data5=geometry_5,
    Data6=geometry_6,
    Data7=geometry_7,
    Data8=geometry_8,
    Data9=geometry_9,
    Data10=geometry_10,
    Data11=geometry_11)  # -> flatten(Result)

custom_preview = CustomPreview(Geometry=merge, Material=ColourSwatch(SwatchColor=RGBA(232, 0, 0, 249)))

# ---- group: Table
geometry_12 = Geometry(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)

# ---- group: Pickup Station
geometry_13 = Geometry(<mesh referenced from the Rhino model>)

# ----
ghpython_script_2 = GhPythonScript(listen=Toggle(True), robot_base_plane=python.Robot_base_plane)  # -> pose, config
# ---------- ghpython_script_2: Python ----------
import rhinoscriptsyntax as rs
import compas
import compas_rhino
import simple_comm as comm
import Rhino.Geometry as rg

reload(comm)

if listen:
    chunks = comm.listen_to_robot("192.168.10.10")
    config = chunks["actual_joints"]
    pose = chunks["pose"]

    
    
pose = compas.geometry.Frame.from_axis_angle_vector([pose[3],pose[4],pose[5]],[pose[0],pose[1],pose[2]])
pose = compas_rhino.conversions.frame_to_rhino(pose)

x = rg.Transform.PlaneToPlane(robot_base_plane, rg.Plane.WorldXY)

#pose.Transform()
# ---------- end ghpython_script_2 ----------

# ---- group: Visualization only
radians = Radians(Degrees=ghpython_script_2.config)
list_item = ListItem(List=radians, Index=0, Wrap=True)  # -> Item, Item1, Item2, Item3, Item4, Item5
ghpython_script_3 = GhPythonScript(x=list_item.Item, y=list_item.Item1, z=list_item.Item2, u=list_item.Item3, v=list_item.Item4, w=list_item.Item5)  # -> configuration
# ---------- ghpython_script_3: Python ----------
import rhinoscriptsyntax as rs

from compas.robots import configuration
from compas_fab.robots import Configuration

configuration = Configuration.from_revolute_values([x,y,z,u,v,w])
# ---------- end ghpython_script_3 ----------
boolean_toggle = BooleanToggle(True)
ur10e = GhPythonScript()  # -> robot
# ---------- ur10e: Python ----------
import os

import compas_fab
from compas.artists import Artist
from compas.geometry import Frame
from compas.robots import RobotModel
from compas.robots.resources import LocalPackageMeshLoader
from compas_fab.backends import AnalyticalInverseKinematics
from compas_fab.backends import OffsetWristKinematics
from compas_fab.backends.interfaces import ClientInterface
from compas_fab.robots import Robot
from compas_fab.robots import RobotSemantics


canvas = ghenv.Component.OnPingDocument()
#
urdf_folder = os.path.join(os.path.dirname(canvas.FilePath), '../dependencies/robots')
#urdf_file = os.path.join(urdf_folder, 'ur10e.urdf')

srdf_file = os.path.join(urdf_folder, 'ur10e.srdf')
#model = RobotModel.from_urdf_file(urdf_file)
#model = RobotModel.from_urdf_file('C:\Zac\GitHub\endless-wall-teamwork\dependencies\ur10.urdf')
urdf_file = compas_fab.get('universal_robot/ur_description/urdf/ur5.urdf')
model = RobotModel.from_urdf_file(urdf_file)

loader = LocalPackageMeshLoader(compas_fab.get('universal_robot'), 'ur_description')
model.load_geometry(loader)

semantics = RobotSemantics.from_srdf_file(srdf_file, model)

client = ClientInterface()
client.is_connected = True
client.inverse_kinematics = AnalyticalInverseKinematics(solver='ur10e')

robot = Robot(model, client=client, semantics=semantics)
robot.artist = Artist(model)
# ---------- end ur10e ----------
robot_visualize = COMPASFABRobotVisualize(
    robot=ur10e,
    configuration=ghpython_script_3,
    show_collision=boolean_toggle,
    show_frames=boolean_toggle,
    show_cm=Toggle(False),
    show_acm=Toggle(False))  # -> visual, collision, collision_meshes, attached_meshes, frames, base_frame, ee_frame; inputs show_visual: Boolean, show_collision: Boolean, show_frames: Boolean, show_base_frame: Boolean, show_end_effector_frame: Boolean, show_cm: Boolean, show_acm: Boolean
#   port group: The planning group used for end-effector and base visualization.
#   port configuration: The robot's full configuration.
#   port show_visual: Whether or not to show the robot's visual meshes.
#   port show_collision: Whether or not to show the robot's collision meshes.
#   port show_frames: Whether or not to show the robot's joint frames.
#   port show_base_frame: Whether or not to show the robot's base frame.
#   port show_end_effector_frame: Whether or not to show the robot's end-effector frame.
#   port show_cm: Whether or not to show the collision meshes (if any).
#   port show_acm: Whether or not to show the attached collision meshes (if any).
#   port visual: Rhino meshes of the robot's visual geometry (if any).
#   port collision: Rhino meshes of the robot's collision geometry (if any).
#   port collision_meshes: Rhino meshes of the scene's collision meshes (if any).
#   port attached_meshes: Rhino meshes of the scene's attached collision meshes (if any).
#   port frames: The robot's joint frames as Rhino planes (if any).
#   port base_frame: The robot's base frame as a Rhino plane (if any).
#   port ee_frame: The robot's end-effector frame as a Rhino plane (if any).
# ---------- robot_visualize: Python ----------
"""
Visualizes the robot.

COMPAS FAB v0.27.0
"""
from compas.artists import Artist
from compas.geometry import Frame
from compas.geometry import Transformation
from compas_fab.robots import PlanningScene
from ghpythonlib.componentbase import executingcomponent as component
import Rhino.Geometry as rg


class RobotVisualize(component):
    def RunScript(
        self,
        robot,
        group,
        configuration,
        show_visual,
        show_collision,
        show_frames,
        show_base_frame,
        show_end_effector_frame,
        show_cm,
        show_acm,
    ):

        visual = None
        collision = None
        collision_meshes = None
        attached_meshes = None
        frames = None
        base_frame = None
        ee_frame = None

        if robot:
            show_visual = True if show_visual is None else show_visual
            show_cm = True if show_cm is None else show_cm
            show_acm = True if show_acm is None else show_acm
            configuration = configuration or robot.zero_configuration()

            robot.update(configuration, visual=show_visual, collision=show_collision)
            compas_frames = robot.transformed_frames(configuration, group)

            if show_visual:
                visual = robot.artist.draw_visual()

            if show_collision:
                collision = robot.artist.draw_collision()

            if show_base_frame:
                base_compas_frame = compas_frames[0]
                artist = Artist(base_compas_frame)
                base_frame = artist.draw()

            if show_end_effector_frame:
                ee_compas_frame = robot.forward_kinematics(
                    configuration, group, options=dict(solver="model")
                )
                artist = Artist(ee_compas_frame)
                ee_frame = artist.draw()

            if show_frames:
                frames = []
                for compas_frame in compas_frames[1:]:
                    artist = Artist(compas_frame)
                    frame = artist.draw()
                    frames.append(frame)

            if show_cm or show_acm:
                scene = PlanningScene(robot)
                scene = robot.client.get_planning_scene()

                collision_meshes = []
                attached_meshes = []

                if show_cm:
                    for co in scene.world.collision_objects:
                        header = co.header
                        frame_id = header.frame_id
                        cms = co.to_collision_meshes()

                        for cm in cms:
                            if cm.frame != Frame.worldXY():
                                t = Transformation.from_frame(cm.frame)
                                mesh = cm.mesh.transformed(t)
                            else:
                                mesh = cm.mesh

                            collision_meshes.append(Artist(mesh).draw())

                if show_acm:
                    for aco in scene.robot_state.attached_collision_objects:
                        for acm in aco.to_attached_collision_meshes():
                            frame_id = aco.object["header"]["frame_id"]
                            frame = robot.forward_kinematics(
                                configuration, options=dict(link=frame_id)
                            )
                            t = Transformation.from_frame(frame)

                            # Local CM frame
                            if (
                                acm.collision_mesh.frame
                                and acm.collision_mesh.frame != Frame.worldXY()
                            ):
                                t = t * Transformation.from_frame(
                                    acm.collision_mesh.frame
                                )

                            mesh = acm.collision_mesh.mesh.transformed(t)

                            attached_meshes.append(Artist(mesh).draw())
#        for v in visual:
#            v.Transform(rg.Transform.Scale(rg.Point3d(0,0,0),10))
        return (
            visual,
            collision,
            collision_meshes,
            attached_meshes,
            frames,
            base_frame,
            ee_frame,
        )
# ---------- end robot_visualize ----------
construct_plane_2 = ConstructPlane(Origin=Point(0, 0, 0), XAxis=Vector(1, 0, 0), YAxis=Vector(0, 1, 0))
panel = Panel("1000")
scale = Scale(Geometry=robot_visualize.visual, Center=construct_plane_2, Factor=panel)  # -> Geometry, Transform
geometry_14 = Geometry(scale.Geometry)

# ----
scale_2 = Scale(Geometry=robot_visualize.frames, Center=construct_plane_2, Factor=panel)  # -> Geometry, Transform

# ---- group: Visualization only (continued)
list_item_2 = ListItem(List=scale_2.Geometry, Index=0, Wrap=True)  # -> Item1, Item

# ----
deconstruct_plane = DeconstructPlane(Plane=list_item_2.Item1)  # -> Origin, XAxis, YAxis, ZAxis
unit_vector = UnitVector(Vector=deconstruct_plane.ZAxis)

# ---- group: Visualization only (continued)
multiplication = Multiplication(A=unit_vector, B="80")
move = Move(Geometry=list_item_2.Item1, Motion=multiplication)  # -> Geometry, Transform
construct_plane_3 = ConstructPlane(Origin=move.Geometry, XAxis=Vector(1, 0, 0), YAxis=Vector(0, 1, 0))
geometry_15 = Geometry(construct_plane_3)
orient = Orient(Geometry=scale.Geometry, Source=geometry_15, Target=PlaneXY(0, 0, 0))  # -> Geometry, Transform

# ----
rotate = Rotate(Geometry=orient.Geometry, Angle=-1.570796327, Plane=PlaneXY(0, 0, 0))  # -> Geometry, Transform
